# Grasshopper definition 251020 - Robotic Fabrication - Tile placement full script.gh (Grasshopper 1.0.8)
# plug-ins: Robots, Robot Components, Pufferfish, opennest_2 Info, MetaHopper

# ----
# GENERATE ASSET
number_slider = Slider(60, range=0..100)
pt = Point(Point(-467.8762933, -1127.436563, -177.9641775))
rectangle = Rectangle(Plane=pt, XSize=Slider(1183, range=0..10000), YSize=Slider(498, range=0..1000), Radius=0)  # -> Rectangle, Length
boundary = BoundarySurfaces(Edges=rectangle.Rectangle)
popgeo = PopulateGeometry(Geometry=boundary, Count=number_slider, Seed=1)

# ---- group: num_edges range
dom = ConstructDomain(DomainStart=Slider(7, range=0..10), DomainEnd=Slider(10, range=0..10))

# ---- group: random radius range
dom_2 = ConstructDomain(DomainStart=Slider(34, range=0..100), DomainEnd=Slider(42, range=0..100))

# ----
cset = CreateSet(List=flatten(["#72726C", "#72726C", "#72726C", "#72726C", "#72726C", "#72726C", "#72726C", "#72726C", "#72726C", "#72726C", "#72726C", "#72726C", "#72726C", "#72726C", "#72726C", "#72726C", "#72726C", "#72726C", "#72726C", "#72726C", "#72726C", "#72726C", "#72726C", "#72726C", "#72726C", "#203957", "#203957", "#203957", "#203957", "#203957", "#203957", "#203957", "#203957", "#203957", "#203957", "#203957", "#203957", "#203957", "#203957", "#203957", "#543D22", "#543D22", "#543D22", "#543D22", "#543D22", "#543D22", "#543D22", "#543D22", "#543D22", "#543D22", "#543D22", "#543D22", "#543D22", "#543D22"]))  # -> Set, Map
item = ListItem(List=cset.Set, Index=0, Wrap=True)  # -> Item, Item1, Item2

# ---- group: Tool Mesh / Camera & Motor Screw 02
brep = Brep([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])
join = BrepJoin(Breps=brep)  # -> Breps, Closed
mesh = Mesh(join.Breps)
number_slider_2 = Slider(180, range=-180..180)
mjoin = MeshJoin(Meshes=mesh)
rot3d = Rotate3D(Geometry=mjoin, Angle=degrees(number_slider_2), Center=Point(0, 0, 0), Axis=Vector(0, 0, 1))  # -> Geometry, Transform

# ---- group: TCP Points
default_tcp_sprint = Point(Point(186.4320426, -0.0001053250157, 74.40559159))  # disabled

# ---- group: TCP Points / pointer
neg = Negative(Value="1.86")
pt_2 = ConstructPoint(XCoordinate=neg, YCoordinate="3.12", ZCoordinate="133.15")
pt_3 = Point(pt_2)
rot3d_2 = Rotate3D(Geometry=pt_3, Angle=degrees(number_slider_2), Center=Point(0, 0, 0), Axis=Vector(0, 0, 1))  # -> Geometry, Transform

# ---- group: Placing board
crv = Curve(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)

# ---- group: Position of the platform
rec_3pt = Rectangle3Pt(PointA="1092.20,299.50,-7.50", PointB="596.10,299.50,-6.50", PointC="598.40,-301.45,-6.25")  # -> Rectangle, Length

# ---- group: Placing board
crv_2 = Curve(rec_3pt.Rectangle)
area = Area(Geometry=crv_2)  # -> Area, Centroid
area_2 = Area(Geometry=crv)  # -> Area, Centroid
vec2pt = Vector2Pt(PointA=area_2.Centroid, PointB=area.Centroid, Unitize=False)  # -> Vector, Length
move = Move(Geometry=crv, Motion=vec2pt.Vector)  # -> Geometry, Transform
crv_3 = Curve(move.Geometry)

# ----
generated_scanned = BooleanToggle(True)
open_nest_spacing = Slider(5, range=0..100)

bypass_kangaroo = BooleanToggle(False)
reset_kangaroo = Button()
kangaroo_on_off = BooleanToggle(True)
kangaroo_separation_distance = Slider(10, range=0..100)
normal_solver_zombie_solver = BooleanToggle(False)

send_to_fabrication = Button()

# ---- group: Import and turn into content
merge = Merge(Data1="indices", Data2="Category", Data3="color")

# ---- group: Robot Data
pt_4 = ConstructPoint(XCoordinate=0, YCoordinate=0, ZCoordinate=0)
list = RobotsLibrary(
    {"iaac-IRB140", "iaac-IRB140-Orange", "iaac-IRB120", "iaac-UR10e", "iaac_IRB6700-150/3.20", "UR3e", "UR5e", "UR10e", "UR16e", "UR3", "UR5", "UR10", "UR20", "UR30"}, selected="UR10e",
    Type=0)
xy = XYPlane(Origin=pt_4)
load_robot = LoadRobotSystem(Name=list, Base=xy)

# ----
xy_2 = XYPlane(Origin=rot3d_2.Geometry)

name_of_your_tool = Panel("mechmind")
name_of_your_tool_2 = Panel("sprint")
tool = CreateTool(Name=name_of_your_tool, TCP=xy_2, Weight=0, Centroid=Point(20, 0, 52), Mesh=rot3d.Geometry)  # -> Tool, TCP

# ---- group: Placing board
spacing_from_boundary = Slider(10, range=0..30)
neg_2 = Negative(Value=spacing_from_boundary)
boundary_2 = BoundarySurfaces(Edges=reparameterize(crv_3))
offset = OffsetCurve(Curve=crv_3, Distance=neg_2, Corners=1)  # -> flatten(Curve)
srf = Surface(boundary_2)

# ---- group: Robot Table display
ur_table_iaac = Brep([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])
swatch = ColourSwatch(SwatchColor=RGBA(171, 171, 171, 22))

# ---- group: start shape
crv_4 = Curve([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])
topoly = CurveToPolyline(Curve=crv_4, ToleranceDistance=Slider(1, range=0..10), ToleranceAngle=0)  # -> Polyline, Segments

# ----
radii = Radii(kangaroo_separation_distance)

# ---- group: disable for zombie solver
grab = Grab(On=True, Strength=Slider(1000, range=0..1000), Range=Slider(10, range=0..10))

# ----
speed_fast = Panel("100")
wait_time = Panel("2")
safe_intermediate_point = Point(Point(394.9339287, -761.6812967, 236.5973737))
end_effector_digital_output = Panel("0")
list_2 = FlagFields({"Shoulder": 1, "Elbow": 2, "Wrist": 4}, selected=[])
clearence_plane = Panel("-60")
speed_slow = Panel("50")

gate = StreamGate(Stream=grab, Gate=normal_solver_zombie_solver)  # -> Target0, Target1
wait = Wait(Time=wait_time)
wait_2 = Wait(Time=wait_time)
capture_pose01 = Panel("""90.00
-80.00
65.00
-75.00
-90.00
0.00""")
list_3 = ValueList({"0.1", "0.01", "0.001", "0.0001"}, selected="0.01")
list_4 = ValueList({"0.1", "0.01", "0.001", "0.0001"}, selected="0.0001")

# ----
# Higher threshold converge faster
list_5 = ValueList({"0.1", "0.01", "0.001", "0.0001"}, selected="0.001")
list_6 = ValueList({"0.1", "0.01", "0.001", "0.0001"}, selected="0.0001")

# ---- group: 00-Start End position
degtorad = DegreesToRadians(Degrees=capture_pose01, RobotSystem=load_robot, MechanicalGroup=0)
target = CreateTarget(Joints=degtorad, Tool=tool.Tool, Speed=speed_fast, Zone="10", IsCartesian=False)

# ----
nest_options = Options(
    Rotations=Slider(360, range=0..360),
    Wiggle=Slider(1, range=0..5.01),
    PlacementType=Slider(2, range=0..2),
    Spacing=open_nest_spacing,
    Seed=Slider(10, range=0..100),
    SimplifyTolerance=Slider(10, range=0.01..10),
    Mutation=Slider(10, range=1..100),
    Population=Slider(10000, range=1..100000),
    Time=Slider(0, range=0..120),
    SheetFont="MecSoft_Font-1 -10")

# ---- group: simulation
number_slider_3 = Slider(0, range=0..1)

# ---- group: Preview tiles in simulation
toggle = GroupToggle(ToggleActive=False, ToggleVisible=True)  # disabled

# ---- group: Preview table and robot
toggle_2 = GroupToggle(ToggleActive=False, ToggleVisible=True)  # disabled

# ---- group: IP Adrress
panel = Panel("192.168.56.101")

# ---- group: Upload
button = Button()

# ---- group: Play
button_2 = Button()

# ---- group: Pause
button_3 = Button()

# ----
pv = PlaneVisualizer(Plane=<missing>)

pt_5 = Point(graft(popgeo))
lng = ListLength(List=popgeo)
random = Random(Range="20000", Number=lng, Seed=2)  # -> flatten(Random)
random_2 = Random(Range=dom, Number=lng, Seed=2)
random_3 = Random(Range=Domain(0, 1), Number=random_2, Seed=random)
sort = SortList(Keys=random_3)  # -> Keys, ValuesA
random_4 = Random(Range=dom_2, Number=random_2, Seed=2)

# ---- group: initial radius
cir = Circle(Plane=pt_5, Radius=Slider(37, range=0..100))

# ----
eval = EvaluateCurve(Curve=reparameterize(cir), Parameter=sort.Keys)  # -> Point, Tangent, Angle
vec2pt_2 = Vector2Pt(PointA=pt_5, PointB=eval.Point, Unitize=False)  # -> Vector, Length
amp = Amplitude(Vector=vec2pt_2.Vector, Amplitude=random_4)
move_2 = Move(Geometry=pt_5, Motion=amp)  # -> Geometry, Transform
hull = ConvexHull(Points=move_2.Geometry, Plane=pt)  # -> Hull, HullZ, Indices

# ---- group: Contours
crv_5 = Curve(flatten(hull.Hull))

# ----
lng_2 = ListLength(List=crv_5)
random_5 = Random(Range=Slider(2, range=0..10), Number=lng_2, Seed=Slider(4, range=0..10))
round = Round(Number=random_5)  # -> Nearest, Floor, Ceiling

lng_3 = ListLength(List=crv_5)
series = Series(Start=0, Step=1, Count=lng_3)  # -> simplify(graft(Series))

geo = Geometry(crv_5)
boundary_3 = BoundarySurfaces(Edges=geo)

# ---- group: sort objects
area_3 = Area(Geometry=boundary_3)  # -> Area, flatten(Centroid)
sort_pt = SortPoints(Points=area_3.Centroid)  # -> Points, Indices
pline = PolyLine(Vertices=sort_pt.Points, Closed=False)
item_2 = ListItem(List=flatten(boundary_3), Index=sort_pt.Indices, Wrap=True)  # -> graft(Item)

# ----
item_3 = ListItem(List=round.Nearest, Index=sort_pt.Indices, Wrap=True)  # -> graft(Item)

p_n_c = PickNChoose(Pattern=graft(item_3), Stream0=item.Item, Stream1=item.Item1, Stream2=item.Item2)  # -> simplify(Result)
merge_2 = Merge(Data1=simplify(series), Data2=simplify(item_3), Data3=simplify(p_n_c))
merge_3 = Merge(Data1="indices", Data2="Category", Data3="color")
u_text = UserText(Content=graft(item_2), Keys=merge_3, Values=merge_2, UserTextMode=1)  # -> simplify(Content), Keys, Values

# ---- group: you need to use data container to carry CONTENT
data = Data(u_text.Content)

# ---- group: Import and turn into content
# IMPORT SCANNED ASSET
path = FilePath("C:\Users\nesbe\Downloads\ALL_CLUSTERS_20251016_155307.json")
py3 = Python3Script(FileOrFolder=path, UseLatestInFolder=Toggle(True), MakeClosed=Toggle(True))  # -> flatten(Polylines), flatten(Centroids), flatten(MeanColors), Info
# ---------- py3: Python ----------
# GHPython script (Rhino/Grasshopper)
# Inputs:
#   FileOrFolder      : str (File Path OR folder)
#   UseLatestInFolder : bool (default True)
#   MakeClosed        : bool (default True)
# Outputs:
#   Polylines         : DataTree[Rhino.Geometry.Curve]           # in millimeters
#   Centroids         : DataTree[Rhino.Geometry.Point3d]         # in millimeters
#   MeanColors        : DataTree[System.Drawing.Color]
#   Info              : str

import os, json
import Rhino as rc
from Grasshopper import DataTree
from Grasshopper.Kernel.Data import GH_Path
import System
from System.Drawing import Color

# ---------- helpers ----------
def _bool_or_default(val, default):
    return default if (val is None) else bool(val)

def _latest_json_in_folder(folder):
    files = [os.path.join(folder, f) for f in os.listdir(folder) if f.lower().endswith(".json")]
    if not files:
        raise IOError("No .json files found in folder: {}".format(folder))
    files.sort(key=lambda p: os.path.getmtime(p), reverse=True)
    return files[0]

def _coerce_point3d(obj):
    if isinstance(obj, (list, tuple)) and len(obj) == 3:
        try:
            return rc.Geometry.Point3d(float(obj[0]), float(obj[1]), float(obj[2])), None
        except Exception as e:
            return None, "list/tuple cast failed: {}".format(e)
    if isinstance(obj, dict):
        lower = {str(k).lower(): v for k, v in obj.items()}
        if all(k in lower for k in ("x","y","z")):
            try:
                return rc.Geometry.Point3d(float(lower["x"]), float(lower["y"]), float(lower["z"])), None
            except Exception as e:
                return None, "dict cast failed: {}".format(e)
        return None, "dict missing x/y/z keys"
    return None, "unsupported type: {}".format(type(obj).__name__)

def _make_polylinecurve(pts, make_closed=True, tol=1e-9):
    if not pts or len(pts) < 2:
        return None
    pl = rc.Geometry.Polyline()
    for p in pts:
        pl.Add(p)
    if make_closed and pl.Count >= 3:
        last_idx = pl.Count - 1
        if pl[0].DistanceTo(pl[last_idx]) > tol:
            pl.Add(pl[0])
    try:
        plc = pl.ToPolylineCurve()
        if plc and plc.IsValid:
            return plc
    except:
        pass
    try:
        plc = rc.Geometry.PolylineCurve(list(pl))
        if plc and plc.IsValid:
            return plc
    except:
        pass
    return None

def _rgb_to_color(rgb):
    """rgb can be [r,g,b] in 0..1 or 0..255 -> System.Drawing.Color"""
    if not isinstance(rgb, (list, tuple)) or len(rgb) != 3:
        return None
    try:
        r, g, b = float(rgb[0]), float(rgb[1]), float(rgb[2])
    except:
        return None
    if max(r, g, b) <= 1.0:
        r, g, b = int(round(r * 255.0)), int(round(g * 255.0)), int(round(b * 255.0))
    else:
        r, g, b = int(round(r)), int(round(g)), int(round(b))
    r = max(0, min(255, r))
    g = max(0, min(255, g))
    b = max(0, min(255, b))
    return Color.FromArgb(255, r, g, b)

# --- meters -> millimeters helpers ---
def _mm_xform():
    """Uniform scale x1000 about world origin."""
    return rc.Geometry.Transform.Scale(rc.Geometry.Point3d.Origin, 1000.0)

def _to_mm_curve(curve):
    """Duplicate & scale a curve to mm."""
    if curve is None: return None
    dup = curve.DuplicateCurve()
    if dup is None: return None
    xf = _mm_xform()
    ok = dup.Transform(xf)
    return dup if ok else None

def _to_mm_point(pt):
    """Return a scaled copy of a point in mm."""
    if pt is None: return None
    p = rc.Geometry.Point3d(pt)
    p.Transform(_mm_xform())
    return p

# ---------- inputs / path ----------
if not FileOrFolder:
    raise ValueError("Provide a file path or a folder path to your JSON.")

use_latest = _bool_or_default(UseLatestInFolder, True)
make_closed = _bool_or_default(MakeClosed, True)

path = str(FileOrFolder)
if os.path.isdir(path):
    if use_latest:
        path = _latest_json_in_folder(path)
    else:
        raise ValueError("Folder given. Set UseLatestInFolder=True or pass a specific .json file path.")
elif not os.path.isfile(path):
    raise IOError("Path does not exist: {}".format(path))
elif not path.lower().endswith(".json"):
    raise IOError("File is not a .json: {}".format(path))

# ---------- load ----------
with open(path, "r") as f:
    data = json.load(f)

clusters = data.get("clusters", [])
units_in = data.get("units", "meters")  # original units in file (for Info)

# ---------- outputs ----------
Polylines  = DataTree[rc.Geometry.Curve]()          # in mm
Centroids  = DataTree[rc.Geometry.Point3d]()        # in mm
MeanColors = DataTree[Color]()                      

made_pl = 0
made_cent = 0
made_color = 0

# ---------- build ----------
for i, c in enumerate(clusters):
    # indices + color group
    try:
        plane_idx   = int(c.get("plane_index", 1)) if isinstance(c, dict) else 1
        cluster_idx = int(c.get("cluster_index", i)) if isinstance(c, dict) else i
    except:
        plane_idx, cluster_idx = 1, i

    cg = c.get("color_group", {}) if isinstance(c, dict) else {}
    try:
        group_id = int(cg.get("group_id", -1))
    except:
        group_id = -1

    # branch path = {group_id; cluster_index}
    path_key = GH_Path(group_id, cluster_idx)

    # hull -> polyline (meters)
    hull_raw = c.get("hull_3d", [])
    pts = []
    if isinstance(hull_raw, list):
        for h in hull_raw:
            pt, _ = _coerce_point3d(h)
            if pt is not None:
                pts.append(pt)

    plc_m = _make_polylinecurve(pts, make_closed)
    plc_mm = _to_mm_curve(plc_m) if (plc_m is not None and plc_m.IsValid) else None
    if plc_mm is not None and plc_mm.IsValid:
        Polylines.Add(plc_mm, path_key)
        made_pl += 1

    # centroid (meters -> mm)
    cent_raw = c.get("centroid_3d", None)
    if cent_raw is not None:
        cpt_m, _ = _coerce_point3d(cent_raw)
        cpt_mm = _to_mm_point(cpt_m)
        if cpt_mm is not None:
            Centroids.Add(cpt_mm, path_key)
            made_cent += 1

    # mean color (unitless)
    mean_rgb = cg.get("group_mean_rgb", None)
    col = _rgb_to_color(mean_rgb) if mean_rgb is not None else None
    if col is not None:
        MeanColors.Add(col, path_key)
        made_color += 1

# ---------- summary ----------
Info = "File: {} | Clusters: {} | Polylines(mm): {} | Centroids(mm): {} | MeanColors: {} | source_units: {}".format(
    os.path.basename(path), len(clusters), made_pl, made_cent, made_color, units_in
)
# ---------- end py3 ----------
panel_2 = Panel(py3.Info)
cset_2 = CreateSet(List=flatten(py3.MeanColors))  # -> Set, graft(Map)
crv_6 = Curve(py3.Polylines)
area_4 = Area(Geometry=flatten(crv_6))  # -> Area, Centroid
avr = Average(Input=area_4.Centroid)
project = Project(Geometry=crv_6, Plane=area_4.Centroid)  # -> Geometry, Transform
lng_4 = ListLength(List=crv_6)
series_2 = Series(Start=0, Step=1, Count=lng_4)  # -> graft(Series)

# ---- group: Fix curves before scripting
redpline = Reduce(Polyline=project.Geometry, Tolerance=1)  # -> Polyline, Reduction
topoly_2 = CurveToPolyline(Curve=redpline.Polyline, ToleranceDistance=Slider(10, range=0..10), ToleranceAngle=0, MinEdge=Slider(20, range=0..100))  # -> Polyline, Segments
disc = Discontinuity(Curve=topoly_2.Polyline, Level=1)  # -> Points, Parameters
pline_2 = PolyLine(Vertices=disc.Points, Closed=invert(False))  # -> simplify(Polyline)

# ---- group: Import and turn into content (continued)
srf_2 = Surface(graft(pline_2))

# ---- group: sort objects and colors
area_5 = Area(Geometry=srf_2)  # -> Area, flatten(Centroid)
sort_pt_2 = SortPoints(Points=area_5.Centroid)  # -> Points, Indices
pline_3 = PolyLine(Vertices=sort_pt_2.Points, Closed=False)
item_4 = ListItem(List=py3.MeanColors, Index=sort_pt_2.Indices, Wrap=True)
item_5 = ListItem(List=flatten(srf_2), Index=sort_pt_2.Indices, Wrap=True)  # -> graft(Item)
item_6 = ListItem(List=flatten(cset_2.Map), Index=sort_pt_2.Indices, Wrap=True)  # -> graft(Item)

# ---- group: Import and turn into content
graft = GraftTree(Tree=item_4, IncludeEmptyLists=True, IncludeNullItems=True)
merge_4 = Merge(Data1=simplify(series_2), Data2=simplify(item_6), Data3=simplify(graft))

u_text_2 = UserText(Content=graft(item_5), Keys=merge, Values=merge_4, UserTextMode=1)  # -> simplify(Content), Keys, Values

# ----
filter = StreamFilter(Gate=generated_scanned, Stream0=data, Stream1=u_text_2.Content)

# ---- group: you need to use data container to carry CONTENT
data_2 = Data(filter)

# ----
u_text_3 = UserText(Content=data_2, UserTextMode=1)  # -> simplify(Content), Keys, Values
area_6 = Area(Geometry=u_text_3.Content)  # -> Area, Centroid

item_7 = ListItem(List=u_text_3.Values, Index=0, Wrap=True)  # -> Item, Item1, Item2

# ---- group: Show scanned tiles
toggle_3 = GroupToggle(ToggleActive=False, ToggleVisible=True)  # disabled
# Design & Packing
preview = CustomPreview(Geometry=u_text_3.Content, Material=item_7.Item2)
tag = TextTag(Location=area_6.Centroid, Text=item_7.Item, Colour=ColourSwatch(SwatchColor=RGB(0, 0, 0)))

# ----
# OPEN NEST
# SHAPES TO NEST
u_text_4 = UserText(Content=flatten(data_2), Keys="Category", UserTextMode=1)  # -> simplify(Content), Keys, Values

# ---- group: Replace a path by another
path_to_overwrite = Data(u_text_4.Values)
data_3 = Data(graft(u_text_4.Content))
tree_statistics = TreeStatistics(Tree=data_3)  # -> Paths, Length, Count
replace_text = ReplaceText(Text=path_to_overwrite, Find=",", Replace=";", RecursiveReplace=False)
replace_paths = ReplacePaths(Data=data_3, Search=tree_statistics.Paths, Replace=flatten(replace_text))
data_4 = Data(replace_paths)

# ----
panel_3 = Panel("""A tiles of color 1 
B tiles of color 2 
C tiles of color 3""")
lng_5 = ListLength(List=data_4)  # -> flatten(Length)
panel_4 = Panel("""A
B
C""")
rep = ReplaceText(Text=panel_3, Find=panel_4, Replace=lng_5, RecursiveReplace=False)
join_2 = TextJoin(Text=rep)

panel_5 = Panel(rep)
bang = ExplodeTree(Data=data_4)  # -> Branch0, Branch1, Branch2

# ---- group: Show scanned tiles left after nesting
toggle_4 = GroupToggle(ToggleActive=False, ToggleVisible=True)  # disabled

# ---- group: Preview tiles in simulation
toggle_5 = GroupToggle(ToggleActive=False, ToggleVisible=True)  # disabled

# ---- group: Show open nest result
toggle_6 = GroupToggle(ToggleActive=False, ToggleVisible=True)  # disabled

# ---- group: Preview table and robot
toggle_7 = GroupToggle(ToggleActive=False, ToggleVisible=True)  # disabled
preview_2 = CustomPreview(Geometry=ur_table_iaac, Shader=swatch)

# ---- group: Show kangaroo result
toggle_8 = GroupToggle(ToggleActive=False, ToggleVisible=True)  # disabled

# ---- group: Show final tiles tiles
toggle_9 = GroupToggle(ToggleActive=False, ToggleVisible=True)  # disabled

# ---- group: Show kangaroo deviation
# Kangaroo deforms the shape, you can preview here how much it deformed and how it matches with the reality. in black the reality in grey the deformed
toggle_10 = GroupToggle(ToggleActive=False, ToggleVisible=True)  # disabled

# ----
# POSITION CALCULATION AND PREVIEW
boundary_no_offset = Curve(srf)
inside_boundaries = Curve(offset)
original_shapes = Data(flatten(u_text_4.Content))

crv_7 = Curve([boundary_no_offset, inside_boundaries])
wrap = WrapList(Data=crv_7, HasNameParameter=False)

Z = UnitZ(Factor=1)

# ---- group: flip if more than 180
number_slider_4 = Slider(180, range=0..1000)  # disabled

# ---- group: split surface into area
boundary_4 = BoundarySurfaces(Edges=reparameterize(offset))

# ----
project_2 = ProjectCurve(Curve=topoly.Polyline, Brep=boundary_4, Direction=Z)

# ---- group: Align to the robot
xy_3 = XYPlane(Origin=Point(0, 0, 0))

# ---- group: split surface into area (continued)
srfsplit = SurfaceSplit(Surface=boundary_4, Curves=flatten(project_2))  # -> simplify(Fragments)
item_8 = ListItem(List=flatten(srfsplit), Index=0, Wrap=invert(True))  # -> Item, Item1, Item2
entwine = Entwine(Branch00=item_8.Item1, Branch01=item_8.Item, Branch02=item_8.Item2, FlattenInputs=True)  # -> simplify(Result)
srf_3 = Surface(simplify(entwine))

area_7 = Area(Geometry=srf_3)  # -> Area, Centroid
sort_2 = SortList(Keys=area_7.Area, ValuesA=srf_3)  # -> Keys, reverse(ValuesA)

srf_4 = Surface(simplify(sort_2.ValuesA))

# ---- group: here insert your surface grafted in 3 branches, one per color
srf_5 = Surface(srf_4)

# ----
# SHAPES TO
# NEST IN
bang_2 = ExplodeTree(Data=srf_5)  # -> Branch0, Branch1, Branch2

# ---- group: I know
toggle_11 = BooleanToggle(True)
geometry = Geometry(Outlines=bang.Branch0, Simplify=-100, Hull=invert(False))  # -> Geometry, Borders
geometry_2 = Geometry(Outlines=bang.Branch1, Simplify=-100, Hull=invert(False))  # -> Geometry, Borders
geometry_3 = Geometry(Outlines=bang.Branch2, Simplify=-100, Hull=invert(False))  # -> Geometry, Borders
sheets_srf = SheetsSrf(Surfaces=bang_2.Branch0, Gap=0.1, Count=1)  # -> Sheets, Polylines
sheets_srf_2 = SheetsSrf(Surfaces=bang_2.Branch1, Gap=0.1, Count=1)  # -> Sheets, Polylines
sheets_srf_3 = SheetsSrf(Surfaces=bang_2.Branch2, Gap=0.1, Count=1)  # -> Sheets, Polylines
opennest2 = OpenNest2(Sheets=sheets_srf.Sheets, Geometry=geometry.Geometry, Options=nest_options, Iterations=1, Run=toggle_11)  # -> Sheets, Borders, AllGeometry, Transforms, SheetId, SheetTxt, Attributes
opennest2_2 = OpenNest2(Sheets=sheets_srf_2.Sheets, Geometry=geometry_2.Geometry, Options=nest_options, Iterations=1, Run=toggle_11)  # -> Sheets, Borders, AllGeometry, Transforms, SheetId, SheetTxt, Attributes
opennest2_3 = OpenNest2(Sheets=sheets_srf_3.Sheets, Geometry=geometry_3.Geometry, Options=nest_options, Iterations=1, Run=toggle_11)  # -> Sheets, Borders, AllGeometry, Transforms, SheetId, SheetTxt, Attributes

# ----
entwine_2 = Entwine(Branch00=opennest2.AllGeometry, Branch01=opennest2_2.AllGeometry, Branch02=opennest2_3.AllGeometry, FlattenInputs=True)  # -> simplify(Result)
entwine_3 = Entwine(Branch00=opennest2.SheetId, Branch01=opennest2_2.SheetId, Branch02=opennest2_3.SheetId, FlattenInputs=True)  # -> simplify(Result)

item_9 = ListItem(List=flatten(srf_5), Index=0, Wrap=True)
equals = Equality(FirstNumber=entwine_3, SecondNumber="-1")  # -> Equality, Inequality
area_8 = Area(Geometry=item_9)  # -> Area, Centroid

boundary_no_offset_2 = Curve(srf)
inside_boundaries_2 = Curve(offset)

# ---- group: keep in the frame
mesh_2 = Mesh(inside_boundaries_2)
mjoin_2 = MeshJoin(Meshes=mesh_2)

# ----
Z_2 = UnitZ(Factor=Slider(-5, range=-100..100))

# ---- group: Extrusion Off
setdo = SetDO(DO=end_effector_digital_output, Value="False")
merge_5 = Merge(Data1=wait, Data2=setdo, Data3=wait)
groupcmd = GroupCommand(Commands=merge_5)
list_7 = ValueList({"Joint", "Linear"}, selected="Linear")

# ----
Z_3 = UnitZ(Factor=1)

Z_4 = UnitZ(Factor=1)

Z_5 = UnitZ(Factor=1)

# ---- group: Safe middle position
xy_4 = XYPlane(Origin=safe_intermediate_point)
pflip = FlipPlane(Plane=xy_4, ReverseX=False, ReverseY=False, SwapAxes=True)

# ---- group: Extrusion On
setdo_2 = SetDO(DO=end_effector_digital_output, Value="TRUE")
merge_6 = Merge(Data1=wait_2, Data2=setdo_2, Data3=wait_2)
groupcmd_2 = GroupCommand(Commands=merge_6)
list_8 = ValueList({"Joint", "Linear"}, selected="Linear")

# ----
number_slider_5 = Slider(1, range=0..10)
number_slider_6 = Slider(100, range=0..100)

# ---- group: Ending Offset
list_9 = ValueList({"Joint", "Linear"}, selected="Joint")

# ---- group: Main Code
list_10 = ValueList({"Joint", "Linear"}, selected="Joint")

# ---- group: Starting Offset
list_11 = ValueList({"Joint", "Linear"}, selected="Joint")

# ---- group: rebuild info
planar = IsPlanar(Surface=inside_boundaries_2, Interior=True)  # -> Planar, Plane

# ----
name_of_the_program = Panel("printing")

# ---- group: replace curves but keep info
cull = CullPattern(List=entwine_2, CullPattern=invert(equals.Equality))  # -> graft(List)
cull_2 = CullPattern(List=data_4, CullPattern=invert(equals.Equality))  # -> graft(List)
u_text_5 = UserText(Content=cull_2, UserTextMode=0)  # -> simplify(Content), Keys, Values

# ----
project_3 = Project(Geometry=cull, Plane=area_8.Centroid)  # -> Geometry, Transform

# ---- group: replace curves but keep info (continued)
u_text_6 = UserText(Content=project_3.Geometry, Keys=u_text_5.Keys, Values=u_text_5.Values, UserTextMode=0)  # -> simplify(Content), Keys, Values

# ----
# KANGAROO
u_text_7 = UserText(Content=u_text_6.Content, UserTextMode=1)  # -> Content, Keys, Values

# ---- group: subdivide shape into precise division
crv_8 = Curve(u_text_7.Content)

# ----
disc_2 = Discontinuity(Curve=crv_8, Level=1)  # -> Points, Parameters

pcen = PolygonCenter(Polyline=graft(crv_8))  # -> CenterV, CenterE, CenterA

# ---- group: Check colision and avoid overlap
explode = Explode(Curve=flatten(crv_8), Recursive=True)  # -> Segments, Vertices
line = Line(explode.Segments)
collider = Collider(Objects=flatten(line), Radii=radii, Strength="1000")

# ----
pt_6 = Point(flatten(pcen.CenterV))
anchor = Anchor(Point=pt_6, Target=pt_6, Strength=Slider(0.832, range=0..1))  # disabled

# ---- group: Keep each individual shape strongly attached of each center
area_9 = Area(Geometry=crv_8)  # -> Area, flatten(Centroid)
prox = Proximity2D(Points=area_9.Centroid, Plane=PlaneXY(0, 0, 0), Group=5)  # -> flatten(Links), Topology
length_line = LengthLine(Line=prox.Links, Strength="-500")

# ----
explode_2 = Explode(Curve=crv_8, Recursive=True)  # -> Segments, Vertices
shift = ShiftList(List=explode_2.Segments, Shift=1, Wrap=True)
angle = Angle(LineA=explode_2.Segments, LineB=shift, Strength=Slider(1000, range=0..1000))  # -> flatten(Angle)

# ---- group: Keep each individual shape strongly attached of each center
inter = InterconnectPoints(Pts=disc_2.Points)
length_line_2 = LengthLine(Line=inter, Strength="1000")

# ---- group: keep everything on the plane
pt_7 = Point(disc_2.Points)
anchorxyz = AnchorXYZ(Point=flatten(pt_7), X=False, Y=False, Z=invert(False), Strength="10000")

# ---- group: keep in the frame (continued)
onmesh = OnMesh(Points=flatten(disc_2.Points), Mesh=mjoin_2, Strength="1000")

# ----
rigidpointset = RigidPointSet(Points=disc_2.Points, Strength=Slider(1000, range=0..1000))  # -> RigidBody, Planes

cc = CurveCollide(
    Curves=flatten(crv_8),
    PassiveCurves=boundary_no_offset_2,
    BasePlane=PlaneXY(0, 0, 0),
    Strength=Slider(1000, range=0..1000))  # -> Goal, Frames

# ---- group: keep track of the shape for display
show = Show(G=flatten(crv_8))

# ----
entwine_4 = Entwine(
    Branch00=show,
    Branch01=flatten([collider, anchorxyz, length_line_2, anchor, onmesh, length_line, cc.Goal, rigidpointset.RigidBody, gate.Target0, angle]),
    FlattenInputs=True)
gate_2 = StreamGate(Stream=entwine_4, Gate=normal_solver_zombie_solver)  # -> Target0, Target1

# ---- group: automaticaly reset kangaroo on opennest change
brec = BoundingRectangle(Geometry=u_text_7.Content, Plane=PlaneXY(0, 0, 0), Axis=0, Slide=0, Union=True)  # -> Bounding, DimensionX, DimensionY
area_10 = Area(Geometry=brec.Bounding)  # -> Area, Centroid
ma = MassAddition(Input=flatten(area_10.Area))  # -> Result, PartialResults
dam = DataDam(DataA=ma.Result, BufferDelay=5000000, BufferMode=2)
equals_2 = Equality(FirstNumber=ma.Result, SecondNumber=dam)  # -> Equality, Inequality
or = GateOr(A=equals_2.Inequality, B=reset_kangaroo)

# ----
zombiesolver = ZombieSolver(GoalObjects=gate_2.Target1, Threshold=list_3, Tolerance=list_4, MaxIterations=Slider(65, range=0..100))  # -> I, V, O
lng_6 = ListLength(List=flatten(crv_8))
series_3 = Series(Start=0, Step=1, Count=lng_6)
item_10 = ListItem(List=zombiesolver.O, Index=series_3, Wrap=True)

# ---- group: rebuild info / replace curves but keep info
u_text_8 = UserText(Content=u_text_7.Content, UserTextMode=0)  # -> simplify(Content), Keys, Values

# ----
u_text_9 = UserText(Content=u_text_6.Content, Keys="indices", UserTextMode=1)  # -> Content, Keys, Values
area_11 = Area(Geometry=u_text_9.Content)  # -> Area, Centroid

u_text_10 = UserText(Content=u_text_6.Content, Keys="color", UserTextMode=1)  # -> Content, Keys, Values

srf_6 = Surface(u_text_10.Content)

# ---- group: Show open nest result (continued)
tag_2 = TextTag(Location=area_11.Centroid, Text=u_text_9.Values, Colour=ColourSwatch(SwatchColor=RGB(0, 0, 0)))
preview_3 = CustomPreview(Geometry=srf_6, Material=u_text_10.Values)

# ----
solver = Solver(GoalObjects=gate_2.Target0, Reset=or, Threshold=list_5, Tolerance=list_6, On=kangaroo_on_off)  # -> I, V, O
bang_3 = ExplodeTree(Data=solver.O)  # -> Branch0, Branch1

filter_2 = StreamFilter(Gate=normal_solver_zombie_solver, Stream0=bang_3.Branch0, Stream1=item_10)

geo_2 = Geometry(filter_2)

# ---- group: rebuild info (continued)
data_5 = Data(geo_2)
match = MatchTree(Tree=graft(data_5), Guide=u_text_8.Content)
project_4 = Project(Geometry=match, Plane=planar.Plane)  # -> Geometry, Transform
u_text_11 = UserText(Content=project_4.Geometry, Keys=u_text_8.Keys, Values=u_text_8.Values, UserTextMode=0)  # -> simplify(Content), Keys, Values

# ----
item_11 = ListItem(List=u_text_11.Values, Index=0, Wrap=True)  # -> Item, Item1, Item2, Item3
boundary_5 = BoundarySurfaces(Edges=u_text_11.Content)

area_12 = Area(Geometry=boundary_5)  # -> Area, Centroid

# ---- group: Show kangaroo result (continued)
preview_4 = CustomPreview(Geometry=boundary_5, Material=item_11.Item2)
tag_3 = TextTag(Location=area_12.Centroid, Text=item_11.Item, Colour=ColourSwatch(SwatchColor=RGB(0, 0, 0)))

# ----
filter_3 = StreamFilter(Gate=bypass_kangaroo, Stream0=u_text_11.Content, Stream1=u_text_7.Content)

u_text_12 = UserText(Content=filter_3, UserTextMode=0)  # -> simplify(Content), Keys, Values

# ---- group: Filter
item_12 = ListItem(List=u_text_12.Values, Index=0, Wrap=True)  # -> Item, Item1, Item2
item_13 = ListItem(List=original_shapes, Index=item_12.Item, Wrap=True)

# ---- group: move originals over placed
area_13 = Area(Geometry=u_text_12.Content)  # -> Area, Centroid
area_14 = Area(Geometry=item_13)  # -> Area, Centroid
vec2pt_3 = Vector2Pt(PointA=flatten(area_14.Centroid), PointB=flatten(area_13.Centroid), Unitize=False)  # -> Vector, Length
move_3 = Move(Geometry=flatten(item_13), Motion=vec2pt_3.Vector)  # -> Geometry, Transform

# ----
crv_9 = Curve(simplify(item_13))

explode_3 = Explode(Curve=crv_9, Recursive=True)  # -> Segments, Vertices
len = Length(Curve=explode_3.Segments)
sort_3 = SortList(Keys=len, ValuesA=explode_3.Segments)  # -> Keys, ValuesA
item_14 = ListItem(List=reverse(sort_3.ValuesA), Index=0, Wrap=True)

end = EndPoints(Curve=item_14)  # -> Start, End
pl = PlaneNormal(Origin=end.Start, ZAxis=Z_4)
align = AlignPlane(Plane=pl, Direction=item_14)  # -> Plane, Angle

u_text_13 = UserText(Content=u_text_12.Content, UserTextMode=0)  # -> simplify(Content), Keys, Values
crv_10 = Curve(u_text_13.Content)

# ---- group: picking planes
area_15 = Area(Geometry=crv_9)  # -> Area, Centroid
pl_origin = PlaneOrigin(Base=align.Plane, Origin=area_15.Centroid)

# ----
item_15 = ListItem(List=u_text_13.Values, Index=0, Wrap=True)  # -> Item, Item1, Item2

boundary_6 = BoundarySurfaces(Edges=graft(item_13))
area_16 = Area(Geometry=boundary_6)  # -> Area, Centroid

dash = DashPattern(Curve=[original_shapes, boundary_no_offset, inside_boundaries, crv_10], Pattern=Slider(10, range=0..10))  # -> Dashes, Gaps

# ---- group: Show scanned tiles left after nesting (continued)
tag_4 = TextTag(Location=area_16.Centroid, Text=item_15.Item, Colour=ColourSwatch(SwatchColor=RGB(51, 51, 51)))
preview_5 = CustomPreview(Geometry=dash.Dashes, Material=ColourSwatch(SwatchColor=RGB(191, 191, 191)))
preview_6 = CustomPreview(Geometry=boundary_6, Material=item_15.Item2)

# ----
original_shapes_after_open_nest = Data(item_13)

# ----
# Find the longest edges in a shape and try to match the original shapes on it using that information
original_moved = Curve(move_3.Geometry)
placed_tiles = Curve(u_text_12.Content)
explode_4 = Explode(Curve=placed_tiles, Recursive=True)  # -> Segments, Vertices
explode_5 = Explode(Curve=original_moved, Recursive=True)  # -> Segments, Vertices
len_2 = Length(Curve=explode_4.Segments)
len_3 = Length(Curve=explode_5.Segments)
sort_4 = SortList(Keys=len_2, ValuesA=explode_4.Segments)  # -> Keys, ValuesA
sort_5 = SortList(Keys=len_3, ValuesA=explode_5.Segments)  # -> Keys, ValuesA
item_16 = ListItem(List=reverse(sort_5.Keys), Index=0, Wrap=True)

multiplication = Multiplication(A=item_16, B="1.5")

# ---- group: delete kangaroo bugs
larger = LargerThan(FirstNumber=multiplication, SecondNumber=sort_4.ValuesA)  # -> LargerThan, OrEqualTo
cull_3 = CullPattern(List=sort_4.ValuesA, CullPattern=larger.LargerThan)
len_4 = Length(Curve=cull_3)
sort_6 = SortList(Keys=len_4, ValuesA=cull_3)  # -> Keys, ValuesA

# ----
item_17 = ListItem(List=reverse(sort_6.ValuesA), Index=0, Wrap=True)

item_18 = ListItem(List=reverse(sort_5.ValuesA), Index=0, Wrap=True)

end_2 = EndPoints(Curve=item_18)  # -> Start, End
pl_2 = PlaneNormal(Origin=end_2.Start, ZAxis=Z_3)
align_2 = AlignPlane(Plane=pl_2, Direction=item_18)  # -> Plane, Angle

end_3 = EndPoints(Curve=item_17)  # -> Start, End
pl_3 = PlaneNormal(Origin=end_3.Start, ZAxis=Z_5)
align_3 = AlignPlane(Plane=pl_3, Direction=item_17)  # -> Plane, Angle

# ---- group: placing plane
area_17 = Area(Geometry=placed_tiles)  # -> Area, Centroid
pl_origin_2 = PlaneOrigin(Base=align_3.Plane, Origin=area_17.Centroid)

# ----
orient = Orient(Geometry=graft(item_13), Source=pl_origin, Target=pl_origin_2)  # -> Geometry, Transform

divide = DivideCurve(Curve=placed_tiles, Count=number_slider_6, Kinks=False)  # -> Points, Tangents, Parameters
divide_2 = DivideCurve(Curve=orient.Geometry, Count=number_slider_6, Kinks=False)  # -> Points, Tangents, Parameters
ln = Line(StartPoint=divide.Points, EndPoint=divide_2.Points)  # -> graft(Line)
cluster = Cluster_2(C=ln)

crv_11 = Curve(orient.Geometry)

# ---- group: Show kangaroo deviation (continued)
preview_7 = CustomPreview(Geometry=simplify(ln), Material=cluster)
preview_8 = CustomPreview(Geometry=placed_tiles, Material=ColourSwatch(SwatchColor=RGB(168, 168, 168)))
preview_9 = CustomPreview(Geometry=crv_11, Material=ColourSwatch(SwatchColor=RGB(0, 0, 0)))

# ----
dam_2 = DataDam(
    DataA=original_shapes_after_open_nest,
    DataB=pl_origin,
    DataC=pl_origin_2,
    DataD=crv_7,
    BufferDelay=5000000,
    BufferMode=0)  # -> DataA, DataB, DataC, DataD
connected = GetConnectedObjects(Objects=dam_2.DataA)
setobj = SetObjectValue(ObjectToSet=connected, ValueToSet=send_to_fabrication)

original_shapes_after_open_nest_2 = Data(dam_2.DataA)
placing_plane = Plane(dam_2.DataC)
unused_tiles = Curve(dam_2.DataD)
# Robotic Fabrication
pick_plane = Plane(dam_2.DataB)
dash_2 = DashPattern(Curve=unused_tiles, Pattern=Slider(7, range=0..10))  # -> Dashes, Gaps
xy_5 = XYPlane(Origin=pick_plane)
pflip_2 = FlipPlane(Plane=xy_5, ReverseX=False, ReverseY=False, SwapAxes=True)

# ---- group: Align to the robot (continued)
deplane = DeconstructPlane(Plane=pflip_2)  # -> Origin, XAxis, YAxis, ZAxis
project_5 = Project(Geometry=xy_3, Plane=deplane.Origin)  # -> Geometry, Transform
ln_2 = Line(StartPoint=deplane.Origin, EndPoint=project_5.Geometry)
align_4 = AlignPlane(Plane=pflip_2, Direction=ln_2)  # -> Plane, Angle

# ----
rotate = Rotate(Geometry=align_4.Plane, Angle=degrees(1.570796327), Plane=xy_5)  # -> Geometry, Transform
pl_origin_3 = PlaneOrigin(Base=rotate.Geometry, Origin=placing_plane)
pln = Plane(rotate.Geometry)
picking_planes = Plane(simplify(pln))
u_text_14 = UserText(Content=original_shapes_after_open_nest_2, UserTextMode=0)  # -> simplify(Content), Keys, Values

picking_planes_2 = Plane(simplify(picking_planes))
move_4 = Move(Geometry=picking_planes_2, Motion=Z_2)  # -> Geometry, Transform

item_19 = ListItem(List=u_text_14.Values, Index=0, Wrap=True)  # -> Item, Item1, Item2, Item3

# ---- group: Safe middle position (continued)
lng_7 = ListLength(List=move_4.Geometry)
repeat = RepeatData(Data=pflip, Length=lng_7)  # -> simplify(Data)

# ---- group: Starting Offset (continued)
pl_offset = PlaneOffset(BasePlane=move_4.Geometry, Offset=clearence_plane)
target_2 = CreateTarget(Plane=pl_offset, RobConf=list_2, Motion=list_11, Tool=tool.Tool, Speed=speed_fast, Zone="5", IsCartesian=True)

# ---- group: Main Code (continued)
target_3 = CreateTarget(Plane=repeat, RobConf=list_2, Motion=list_10, Tool=tool.Tool, Speed=speed_fast, Zone="5", IsCartesian=True)

# ---- group: Extrusion On (continued)
target_4 = CreateTarget(
    Plane=move_4.Geometry,
    RobConf=list_2,
    Motion=list_8,
    Tool=tool.Tool,
    Speed=speed_slow,
    Zone="5",
    Command=groupcmd_2,
    IsCartesian=True)

# ----
picking_planes_3 = Plane(simplify(picking_planes))

# ---- group: Show all tiles
preview_10 = CustomPreview(
    Geometry=dash_2.Dashes,
    Material={diffuse=RGB(191, 191, 191), emission=RGB(57, 57, 57), shine=0.5, specular=RGB(255, 255, 255), transparency=0})
toggle_12 = GroupToggle(ToggleActive=False, ToggleVisible=True)  # disabled

# ---- group: plane deviation in degrees
pl_origin_4 = PlaneOrigin(Base=placing_plane, Origin=pick_plane)
deplane_2 = DeconstructPlane(Plane=pl_origin_4)  # -> Origin, XAxis, YAxis, ZAxis
deplane_3 = DeconstructPlane(Plane=pick_plane)  # -> Origin, XAxis, YAxis, ZAxis

# ----
xy_6 = XYPlane(Origin=pl_origin_4)

# ---- group: plane deviation in degrees (continued)
angle_2 = Angle(VectorA=deplane_2.XAxis, VectorB=deplane_3.XAxis, Plane=xy_6)  # -> Angle, Reflex
deg = Degrees(Radians=angle_2.Angle)

# ---- group: flip if more than 180 (continued)
neg_3 = Negative(Value=angle_2.Reflex)  # disabled
larger_2 = LargerThan(FirstNumber=deg, SecondNumber=number_slider_4)  # -> LargerThan, OrEqualTo; disabled
deg_2 = Degrees(Radians=neg_3)  # disabled
p_n_c_2 = PickNChoose(Pattern=larger_2.LargerThan, Stream0=deg, Stream1=deg_2)  # disabled

# ----
rotate_2 = Rotate(Geometry=pl_origin_3, Angle=degrees(deg), Plane=pl_origin_3)  # -> Geometry, Transform
pln_2 = Plane(rotate_2.Geometry)
placing_plane_2 = Plane(simplify(pln_2))

# ---- group: test
orient_2 = Orient(Geometry=original_shapes_after_open_nest_2, Source=picking_planes, Target=placing_plane_2)  # -> simplify(Geometry), Transform

# ----
area_18 = Area(Geometry=orient_2.Geometry)  # -> Area, Centroid
placing_plane_3 = Plane(simplify(placing_plane_2))

# ---- group: Show all tiles (continued)
preview_11 = CustomPreview(Geometry=[orient_2.Geometry, u_text_14.Content], Material=item_19.Item2)

# ---- group: Show final tiles tiles (continued)
tag_5 = TextTag(Location=area_18.Centroid, Text=item_19.Item, Colour=ColourSwatch(SwatchColor=RGB(0, 0, 0)))

# ---- group: Ending Offset (continued)
pl_offset_2 = PlaneOffset(BasePlane=placing_plane_3, Offset=clearence_plane)
target_5 = CreateTarget(Plane=pl_offset_2, RobConf=list_2, Motion=list_9, Tool=tool.Tool, Speed=speed_fast, Zone="5", IsCartesian=True)

# ----
pl_offset_3 = PlaneOffset(BasePlane=placing_plane_3, Offset=clearence_plane)
target_6 = CreateTarget(Plane=pl_offset_3, RobConf=list_2, Tool=tool.Tool, Speed=speed_slow, IsCartesian=True)

# ---- group: Extrusion Off (continued)
target_7 = CreateTarget(
    Plane=placing_plane_3,
    RobConf=list_2,
    Motion=list_7,
    Tool=tool.Tool,
    Speed=speed_slow,
    Zone="5",
    Command=groupcmd,
    IsCartesian=True)

# ----
merge_7 = Merge(
    Data1=simplify(target_2),
    Data2=simplify(target_4),
    Data3=simplify(target_3),
    Data4=simplify(target_5),
    Data5=simplify(target_7),
    Data6=simplify(target_6),
    Data7=simplify(target_3))
panel_6 = Panel(merge_7)
entwine_5 = Entwine(Branch00=target, Branch01=merge_7, Branch02=target, FlattenInputs=True)

program = CreateProgram(Name=name_of_the_program, RobotSystem=load_robot, Targets1=flatten(entwine_5), StepSize=1)  # -> Program, Code, Duration, Warnings, Errors
check_errors = Panel(program.Errors)
sim = ProgramSimulation(Program=program.Program, Time=number_slider_3, Normalized=True)  # -> SystemMeshes, JointRotations, Plane, Index, Time, Program, Errors

# ---- group: exporting the file
cluster_2 = Cluster(data=program.Code)
path_2 = FilePath("D:\\")
file_name = Panel("test01")
txt = Text(flatten(cluster_2))
python = GhPythonScript(program=txt, path=path_2, name=file_name, write=Button())  # -> out, a; inputs program: list
# ---------- python: Python ----------
__author__ = "Ric M"
__version__ = "2023.03.16"

import rhinoscriptsyntax as rs

if write:
    with open(path + name + '.script', 'w') as file:
        for line in program:
            file.write(line)
            file.write('\n')
# ---------- end python ----------

# ---- group: Display Data
trail = SimpleTrail(Program=sim.Program, Length="20000", MechanicalGroup=0)
split = SplitList(List=sim.SystemMeshes, Index="7")  # -> ListA, ListB
swatch_2 = ColourSwatch(SwatchColor=RGB(219, 219, 219))
swatch_3 = ColourSwatch(SwatchColor=RGB(212, 212, 212))
preview_12 = CustomPreview(Geometry=trail, Material=ColourSwatch(SwatchColor=RGB(255, 0, 195)))

# ---- group: printing time
division = Division(A=program.Duration, B=60)
round_2 = Round(Number=division)  # -> Nearest, Floor, Ceiling
time_in_minutes = Panel(round_2.Nearest)

# ----
remote = RemoteConnection(Program=sim.Program, IP=panel, Upload=button, Play=button_2, Pause=button_3)

# ---- group: Preview table and robot (continued)
preview_13 = CustomPreview(Geometry=split.ListA, Shader=swatch_2)
preview_14 = CustomPreview(Geometry=split.ListB, Shader=swatch_3)

# ----
to_export_code_to_prg_file = Panel(txt)

# ---- group: Preview tiles in simulation / find if the tile taken or not and which tile index
number_of_target_per_move = Slider(7, range=0..10)
subtraction = Subtraction(A=sim.Index, B=1)
division_2 = Division(A=subtraction, B=number_of_target_per_move)
round_3 = Round(Number=division_2)  # -> Nearest, Floor, Ceiling

subtraction_2 = Subtraction(A=division_2, B=round_3.Floor)
panel_7 = Panel(subtraction_2)
inc = Includes(Value=panel_7, Domain=" 0.15 To 0.58")  # -> Includes, Deviation

# ---- group: Preview tiles in simulation
original_shapes_after_open_nest_3 = Data(flatten(original_shapes_after_open_nest_2))
item_20 = ListItem(List=flatten(original_shapes_after_open_nest_3), Index=round_3.Floor, Wrap=True)
item_21 = ListItem(List=flatten(item_20), Index=round_3.Floor, Wrap=True)
cull_4 = CullPattern(List=item_21, CullPattern=inc.Includes)

u_text_15 = UserText(Content=cull_4, UserTextMode=0)  # -> simplify(Content), Keys, Values
item_22 = ListItem(List=u_text_15.Values, Index=0, Wrap=True)  # -> Item, Item1, Item2, Item3
panel_8 = Panel(item_22.Item1)
panel_9 = Panel(item_22.Item2)
panel_10 = Panel(item_22.Item)

item_23 = ListItem(List=flatten(picking_planes_3), Index=round_3.Floor, Wrap=True)
item_24 = ListItem(List=sim.Plane, Index=7, Wrap=True)
swatch_4 = ColourSwatch(SwatchColor=RGB(0, 0, 0))

# ---- group: Preview tiles in simulation / correct tcp
Z_6 = UnitZ(Factor=Slider(-7, range=-10..0))
move_5 = Move(Geometry=item_24, Motion=Z_6)  # -> Geometry, Transform

# ---- group: Preview tiles in simulation (continued)
orient_3 = Orient(Geometry=u_text_15.Content, Source=item_23, Target=move_5.Geometry)  # -> Geometry, Transform
srf_7 = Surface(orient_3.Geometry)
area_19 = Area(Geometry=srf_7)  # -> Area, Centroid

preview_15 = CustomPreview(Geometry=srf_7, Material=item_22.Item2)
tag_6 = TextTag(Location=area_19.Centroid, Text=item_22.Item, Colour=swatch_4)

# ==== cluster Cluster
data = ClusterInput()

# ---- group: Code to Export
data_2 = Data(data)
trim = TrimTree(Tree=data_2, Depth=expr("2", 1))
graft = GraftTree(Tree=trim, IncludeEmptyLists=True, IncludeNullItems=True)  # -> simplify(Tree)
panel = Panel("""-1
0""")
cull_i = CullIndex(List=flatten(graft), Indices=panel, Wrap=True)

# ----
L = ClusterOutput(cull_i)

# ==== cluster Cluster_2
C = ClusterInput()

# ---- group: Remap list to 0 to 1
len = Length(Curve=C)
number = Number(len)
bounds = Bounds(Numbers=flatten(number))
remap_numbers = RemapNumbers(Value=number, Source=bounds, Target=Domain(0, 1))  # -> Mapped, Clipped
number_2 = Number(remap_numbers.Mapped)
gradient = Gradient(LowerLimit=0, UpperLimit=1, Parameter=number_2, stops=[0: RGB(0, 128, 0), 0.5: RGB(255, 255, 0), 1: RGB(255, 0, 0)])

# ----
C_2 = ClusterOutput(gradient)
