# Grasshopper definition Workshop ceramic 5.gh (Grasshopper 1.0.8)
# plug-ins: Robots, Robot Components, treesloth01, Pufferfish, opennest_2 Info

pt = Point(Point(818.5928122, 44.33721173, 0))  # disabled
number_slider = Slider(10, range=0..100)  # disabled

# ---- group: Amount of Pieces
number_slider_2 = Slider(20, range=0..100)  # disabled
number_slider_3 = Slider(20, range=0..100)  # disabled
sqgrid = Square(Plane=pt, Size=number_slider_2, ExtentX=number_slider_3, ExtentY=number_slider)  # -> Cells, Points; disabled

# ---- group: num_edges range
number_slider_4 = Slider(7, range=0..10)  # disabled
number_slider_5 = Slider(5, range=0..10)  # disabled
dom = ConstructDomain(DomainStart=number_slider_4, DomainEnd=number_slider_5)  # disabled

# ---- group: random radius range
number_slider_6 = Slider(5, range=0..10)  # disabled
number_slider_7 = Slider(5, range=0..10)  # disabled
dom_2 = ConstructDomain(DomainStart=number_slider_6, DomainEnd=number_slider_7)  # disabled

# ----
number_slider_8 = Slider(7, range=0..10)  # disabled
number_slider_9 = Slider(2, range=0..10)  # disabled
swatch = ColourSwatch(SwatchColor=RGB(224, 34, 34))  # disabled
panel = Panel("area")  # disabled

# ---- group: Import and turn into content
merge = Merge(Data1="indices", Data2="Category", Data3="color")

# ---- group: start shape
number_slider_10 = Slider(50, range=0..100)
crv = Curve([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])
topoly = CurveToPolyline(Curve=crv, ToleranceDistance=Slider(1, range=0..10), ToleranceAngle=0)  # -> Polyline, Segments
neg = Negative(Value=number_slider_10)
dom_3 = ConstructDomain(DomainStart=number_slider_10, DomainEnd=neg)
explode = Explode(Curve=topoly.Polyline, Recursive=True)  # -> Segments, Vertices
lng = ListLength(List=explode.Vertices)
area = Area(Geometry=crv)  # -> Area, Centroid
random = Random(Range=dom_3, Number=lng, Seed=2)
moveaway = MoveAwayFrom(Geometry=explode.Vertices, Emitter=area.Centroid, Distance=random)  # -> Geometry, Transform
pline = PolyLine(Vertices=moveaway.Geometry, Closed=invert(False))

# ----
panel_2 = Panel("""A tiles of color 1 
B tiles of color 2 
C tiles of color 3""")
panel_3 = Panel("""A
B
C""")
xy = XYPlane(Origin=Point(0, 0, 0))

nest_options = Options(
    Rotations=Slider(360, range=0..360),
    Wiggle=Slider(1, range=0..5.01),
    PlacementType=Slider(2, range=0..2),
    Spacing=Slider(10, range=0..100),
    Seed=Slider(10, range=0..100),
    SimplifyTolerance=Slider(10, range=0.01..10),
    Mutation=Slider(10, range=1..100),
    Population=Slider(10000, range=1..100000),
    Time=Slider(0, range=0..120),
    SheetFont="MecSoft_Font-1 -10")

radii = Radii(Slider(5, range=0..100))
grab = Grab(On=True, Strength=Slider(1000, range=0..1000), Range=Slider(10, range=0..10))
panel_4 = Panel("39")  # disabled
number_slider_11 = Slider(0.01, range=0..0.01)

reset = Button()
on = BooleanToggle(False)

# ----
# Higher threshold converge faster
list = ValueList({"0.1", "0.01", "0.001", "0.0001"}, selected="0.01")
list_2 = ValueList({"0.1", "0.01", "0.001", "0.0001"}, selected="0.0001")

# ---- group: Autmaticaly detect changes in the opennest and re initiate the kangaroo process on change
py3 = Python3Script(x=flatten(panel_4))  # -> out, changed; inputs x: list; disabled
# ---------- py3: Python ----------
import scriptcontext as sc
import time
import copy

# Pulse duration in seconds
pulse_duration = 1.0

# Sticky keys
key_prev = 'pulse_prev'
key_end = 'pulse_end'
key_pulse = 'pulse_state'

# Initialize sticky storage
if key_prev not in sc.sticky:
    sc.sticky[key_prev] = None
if key_end not in sc.sticky:
    sc.sticky[key_end] = 0
if key_pulse not in sc.sticky:
    sc.sticky[key_pulse] = False

prev = sc.sticky[key_prev]
pulse_end_time = sc.sticky[key_end]
pulse_active = sc.sticky[key_pulse]

now = time.time()

# Detect input change
current = list(x) if isinstance(x, list) else x
changed_flag = False

if isinstance(current, list):
    if prev is None or len(prev) != len(current):
        changed_flag = True
    else:
        for a, b in zip(prev, current):
            if a != b:
                changed_flag = True
                break
else:
    if prev != current:
        changed_flag = True

# Activate pulse on change
if changed_flag:
    pulse_active = True
    pulse_end_time = now + pulse_duration
    sc.sticky[key_prev] = copy.deepcopy(current) if isinstance(current, list) else current

# Check if pulse duration expired
if pulse_active and now >= pulse_end_time:
    pulse_active = False

# Store state
sc.sticky[key_end] = pulse_end_time
sc.sticky[key_pulse] = pulse_active

# Output
changed = pulse_active
# ---------- end py3 ----------

# ----
panel_5 = Panel(py3.changed)  # disabled
bypass_kangaroo = BooleanToggle(True)
swatch_2 = ColourSwatch(SwatchColor=RGB(51, 51, 51))
avr = Average()

# ---- group: Tool Mesh / Camera & Motor Screw 02
brep = Brep([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])
join = BrepJoin(Breps=brep)  # -> Breps, Closed
mesh = Mesh(join.Breps)
number_slider_12 = Slider(180, range=-180..180)
mjoin = MeshJoin(Meshes=mesh)
rot3d = Rotate3D(Geometry=mjoin, Angle=degrees(number_slider_12), Center=Point(0, 0, 0), Axis=Vector(0, 0, 1))  # -> Geometry, Transform

# ---- group: TCP Points
default_tcp_sprint = Point(Point(186.4320426, -0.0001053250157, 74.40559159))

# ---- group: TCP Points / pointer
neg_2 = Negative(Value="1.86")
pt_2 = ConstructPoint(XCoordinate=neg_2, YCoordinate="3.12", ZCoordinate="133.15")
pt_3 = Point(pt_2)
rot3d_2 = Rotate3D(Geometry=pt_3, Angle=degrees(number_slider_12), Center=Point(0, 0, 0), Axis=Vector(0, 0, 1))  # -> Geometry, Transform

# ---- group: TCP Points / sprint
neg_3 = Negative(Value="-222.38")
pt_4 = ConstructPoint(XCoordinate=neg_3, YCoordinate="0.07", ZCoordinate="72.97")
pt_5 = Point(pt_4)
rot3d_3 = Rotate3D(Geometry=pt_5, Angle=degrees(number_slider_12), Center=Point(0, 0, 0), Axis=Vector(0, 0, 1))  # -> Geometry, Transform

# ---- group: simulation
number_slider_13 = Slider(0, range=0..1)

# ----
number_slider_14 = Slider(57, range=0..180)

rec_3pt = Rectangle3Pt(PointA="1092.20,299.50,-7.50", PointB="596.10,299.50,-6.50", PointC="598.40,-301.45,-6.25")  # -> Rectangle, Length

neg_4 = Negative(Value=number_slider_14)

# ---- group: Robot Data
pt_6 = ConstructPoint(XCoordinate=0, YCoordinate=0, ZCoordinate=0)
list_3 = RobotsLibrary(
    {"CITA-IRB1600-145 + Turntable", "CITA-IRB1600-145 + IRB140", "CITA-IRB1600-145", "CITA-IRB140", "CITA-UR5e", "ETH-Gantry", "iaac-KR150-2_110", "iaac-IRB140", "iaac-IRB120", "iaac-IRB6640-130-320"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}, selected="UR10e",
    Type=0)
xy_2 = XYPlane(Origin=pt_6)
load_robot = LoadRobotSystem(Name=list_3, Base=xy_2)

# ---- group: Robot Table display
ur_table_iaac = Brep([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])
preview = CustomPreview(Geometry=ur_table_iaac, Shader=ColourSwatch(SwatchColor=RGBA(171, 171, 171, 22)))

# ----
xy_3 = XYPlane(Origin=rot3d_2.Geometry)
yz = YZPlane(Origin=rot3d_3.Geometry)

name_of_your_tool = Panel("mechmind")
name_of_your_tool_2 = Panel("sprint")
tool = CreateTool(Name=name_of_your_tool, TCP=xy_3, Weight=0, Centroid=Point(20, 0, 52), Mesh=rot3d.Geometry)  # -> Tool, TCP

clearence_plane = Panel("-60")
layer_height = Panel("2")
speed = Panel("100")
number_slider_15 = Slider(69, range=0..100)
number_slider_16 = Slider(0, range=0..1)
subtraction = Subtraction(A="1", B=number_slider_16)
pt_7 = Point(Point(394.9339287, -761.6812967, 236.5973737))
xy_4 = XYPlane(Origin=pt_7)
pflip = FlipPlane(Plane=xy_4, ReverseX=False, ReverseY=False, SwapAxes=True)
Z = UnitZ(Factor=Slider(-5, range=-100..100))
number_slider_17 = Slider(50, range=0..100)
panel_6 = Panel("""0
0
0
0
0
0""")
for_print_home = Panel("""0
-90
90
0
90
0""")
wait = Wait(Time=Slider(2, range=0..10))
capture_pose01 = Panel("""90.00
-80.00
65.00
-75.00
-90.00
0.00""")
list_4 = FlagFields({"Shoulder": 1, "Elbow": 2, "Wrist": 4}, selected=[])
capture_pose02 = Panel("""109.17
-68.72
50.34
-71.63
-90.03
19.16""")
capture_pose03 = Panel("""73.08
-81.76
67.06
-75.28
-89.99
-16.92""")

# ---- group: 00-Start End position
degtorad = DegreesToRadians(Degrees=capture_pose01, RobotSystem=load_robot, MechanicalGroup=0)
target = CreateTarget(Joints=degtorad, Tool=tool.Tool, Speed=speed, Zone="10", IsCartesian=False)

# ----
name_of_the_program = Panel("printing")

# ---- group: IP Adrress
panel_7 = Panel("192.168.56.101")

# ---- group: Upload
button = Button()

# ---- group: Play
button_2 = Button()

# ---- group: Pause
button_3 = Button()

# ----
disc = Discontinuity(Level=1)  # -> Points, Parameters
avr_2 = Average(Input=disc.Points)

area_2 = Area(Geometry=flatten(sqgrid.Cells))  # -> Area, Centroid; disabled
panel_8 = Panel("20000")  # disabled
pt_8 = Point(graft(area_2.Centroid))  # disabled
lng_2 = ListLength(List=area_2.Centroid)  # disabled
random_2 = Random(Range=panel_8, Number=lng_2, Seed=2)  # -> flatten(Random); disabled
random_3 = Random(Range=dom, Number=lng_2, Seed=2)  # disabled
random_4 = Random(Range=Domain(0, 1), Number=random_3, Seed=random_2)  # disabled
sort = SortList(Keys=random_4)  # -> Keys, ValuesA; disabled
random_5 = Random(Range=dom_2, Number=random_3, Seed=2)  # disabled
pt_9 = Point(pt_8)  # disabled

# ---- group: initial radius
number_slider_18 = Slider(6, range=0..10)  # disabled
cir = Circle(Plane=pt_8, Radius=number_slider_18)  # disabled

# ---- group: random scaling range
panel_9 = Panel(" 0.7 to 1")  # disabled
random_6 = Random(Range=panel_9, Number=lng_2, Seed=2)  # -> graft(Random); disabled

# ----
eval = EvaluateCurve(Curve=reparameterize(cir), Parameter=sort.Keys)  # -> Point, Tangent, Angle; disabled
vec2pt = Vector2Pt(PointA=pt_8, PointB=eval.Point, Unitize=False)  # -> Vector, Length; disabled
amp = Amplitude(Vector=vec2pt.Vector, Amplitude=random_5)  # disabled
move = Move(Geometry=pt_8, Motion=amp)  # -> Geometry, Transform; disabled
hull = ConvexHull(Points=move.Geometry, Plane=PlaneXY(0, 0, 0))  # -> Hull, HullZ, Indices; disabled
scale = Scale(Geometry=hull.Hull, Center=pt_9, Factor=random_6)  # -> Geometry, Transform; disabled

# ---- group: Contours
crv_2 = Curve(flatten(scale.Geometry))  # disabled

# ----
flip = FlipCurve(Curve=crv_2)  # -> Curve, Flag; disabled
scale_2 = Scale(Geometry=flip.Curve, Center=pt, Factor=number_slider_8)  # -> Geometry, Transform; disabled
area_3 = Area(Geometry=crv_2)  # -> graft(Area), Centroid; disabled
crv_3 = Curve(scale_2.Geometry)  # disabled
clean = CleanTree(RemoveNulls=True, RemoveInvalid=True, RemoveEmpty=invert(False), Tree=crv_3)  # -> flatten(Tree); disabled

number_slider_19 = Slider(4, range=0..10)  # disabled
lng_3 = ListLength(List=clean)  # disabled
random_7 = Random(Range=number_slider_9, Number=lng_3, Seed=number_slider_19)  # disabled
round = Round(Number=random_7)  # -> Nearest, Floor, Ceiling; disabled

lng_4 = ListLength(List=clean)  # disabled
series = Series(Start=0, Step=1, Count=lng_4)  # -> simplify(graft(Series)); disabled

panel_10 = Panel(round.Nearest)  # disabled
geo = Geometry(clean)  # disabled

swatch_3 = ColourSwatch(SwatchColor=RGB(138, 138, 138))  # disabled
swatch_4 = ColourSwatch(SwatchColor=RGB(58, 58, 224))  # disabled
p_n_c = PickNChoose(Pattern=graft(round.Nearest), Stream0=swatch_3, Stream1=swatch_4, Stream2=swatch)  # -> simplify(Result); disabled
panel_11 = Panel("indices")  # disabled
panel_12 = Panel("Category")  # disabled
merge_2 = Merge(Data1=simplify(series), Data2=simplify(graft(round.Nearest)), Data3=simplify(p_n_c), Data4=simplify(area_3.Area))  # disabled
merge_3 = Merge(Data1=panel_11, Data2=panel_12, Data3="color", Data4=panel)  # disabled
u_text = UserText(Content=graft(geo), Keys=merge_3, Values=merge_2, UserTextMode=1)  # -> simplify(Content), Keys, Values; disabled

# ---- group: Import and turn into content
path = FilePath("C:\Users\lihua\Downloads\threecolorscan.json")
py3_2 = Python3Script(FileOrFolder=path, UseLatestInFolder=Toggle(True), MakeClosed=Toggle(True))  # -> flatten(Polylines), flatten(Centroids), flatten(MeanColors), Info
# ---------- py3_2: Python ----------
# GHPython script (Rhino/Grasshopper)
# Inputs:
#   FileOrFolder      : str (File Path OR folder)
#   UseLatestInFolder : bool (default True)
#   MakeClosed        : bool (default True)
# Outputs:
#   Polylines         : DataTree[Rhino.Geometry.Curve]           # in millimeters
#   Centroids         : DataTree[Rhino.Geometry.Point3d]         # in millimeters
#   MeanColors        : DataTree[System.Drawing.Color]
#   Info              : str

import os, json
import Rhino as rc
from Grasshopper import DataTree
from Grasshopper.Kernel.Data import GH_Path
import System
from System.Drawing import Color

# ---------- helpers ----------
def _bool_or_default(val, default):
    return default if (val is None) else bool(val)

def _latest_json_in_folder(folder):
    files = [os.path.join(folder, f) for f in os.listdir(folder) if f.lower().endswith(".json")]
    if not files:
        raise IOError("No .json files found in folder: {}".format(folder))
    files.sort(key=lambda p: os.path.getmtime(p), reverse=True)
    return files[0]

def _coerce_point3d(obj):
    if isinstance(obj, (list, tuple)) and len(obj) == 3:
        try:
            return rc.Geometry.Point3d(float(obj[0]), float(obj[1]), float(obj[2])), None
        except Exception as e:
            return None, "list/tuple cast failed: {}".format(e)
    if isinstance(obj, dict):
        lower = {str(k).lower(): v for k, v in obj.items()}
        if all(k in lower for k in ("x","y","z")):
            try:
                return rc.Geometry.Point3d(float(lower["x"]), float(lower["y"]), float(lower["z"])), None
            except Exception as e:
                return None, "dict cast failed: {}".format(e)
        return None, "dict missing x/y/z keys"
    return None, "unsupported type: {}".format(type(obj).__name__)

def _make_polylinecurve(pts, make_closed=True, tol=1e-9):
    if not pts or len(pts) < 2:
        return None
    pl = rc.Geometry.Polyline()
    for p in pts:
        pl.Add(p)
    if make_closed and pl.Count >= 3:
        last_idx = pl.Count - 1
        if pl[0].DistanceTo(pl[last_idx]) > tol:
            pl.Add(pl[0])
    try:
        plc = pl.ToPolylineCurve()
        if plc and plc.IsValid:
            return plc
    except:
        pass
    try:
        plc = rc.Geometry.PolylineCurve(list(pl))
        if plc and plc.IsValid:
            return plc
    except:
        pass
    return None

def _rgb_to_color(rgb):
    """rgb can be [r,g,b] in 0..1 or 0..255 -> System.Drawing.Color"""
    if not isinstance(rgb, (list, tuple)) or len(rgb) != 3:
        return None
    try:
        r, g, b = float(rgb[0]), float(rgb[1]), float(rgb[2])
    except:
        return None
    if max(r, g, b) <= 1.0:
        r, g, b = int(round(r * 255.0)), int(round(g * 255.0)), int(round(b * 255.0))
    else:
        r, g, b = int(round(r)), int(round(g)), int(round(b))
    r = max(0, min(255, r))
    g = max(0, min(255, g))
    b = max(0, min(255, b))
    return Color.FromArgb(255, r, g, b)

# --- meters -> millimeters helpers ---
def _mm_xform():
    """Uniform scale x1000 about world origin."""
    return rc.Geometry.Transform.Scale(rc.Geometry.Point3d.Origin, 1000.0)

def _to_mm_curve(curve):
    """Duplicate & scale a curve to mm."""
    if curve is None: return None
    dup = curve.DuplicateCurve()
    if dup is None: return None
    xf = _mm_xform()
    ok = dup.Transform(xf)
    return dup if ok else None

def _to_mm_point(pt):
    """Return a scaled copy of a point in mm."""
    if pt is None: return None
    p = rc.Geometry.Point3d(pt)
    p.Transform(_mm_xform())
    return p

# ---------- inputs / path ----------
if not FileOrFolder:
    raise ValueError("Provide a file path or a folder path to your JSON.")

use_latest = _bool_or_default(UseLatestInFolder, True)
make_closed = _bool_or_default(MakeClosed, True)

path = str(FileOrFolder)
if os.path.isdir(path):
    if use_latest:
        path = _latest_json_in_folder(path)
    else:
        raise ValueError("Folder given. Set UseLatestInFolder=True or pass a specific .json file path.")
elif not os.path.isfile(path):
    raise IOError("Path does not exist: {}".format(path))
elif not path.lower().endswith(".json"):
    raise IOError("File is not a .json: {}".format(path))

# ---------- load ----------
with open(path, "r") as f:
    data = json.load(f)

clusters = data.get("clusters", [])
units_in = data.get("units", "meters")  # original units in file (for Info)

# ---------- outputs ----------
Polylines  = DataTree[rc.Geometry.Curve]()          # in mm
Centroids  = DataTree[rc.Geometry.Point3d]()        # in mm
MeanColors = DataTree[Color]()                      

made_pl = 0
made_cent = 0
made_color = 0

# ---------- build ----------
for i, c in enumerate(clusters):
    # indices + color group
    try:
        plane_idx   = int(c.get("plane_index", 1)) if isinstance(c, dict) else 1
        cluster_idx = int(c.get("cluster_index", i)) if isinstance(c, dict) else i
    except:
        plane_idx, cluster_idx = 1, i

    cg = c.get("color_group", {}) if isinstance(c, dict) else {}
    try:
        group_id = int(cg.get("group_id", -1))
    except:
        group_id = -1

    # branch path = {group_id; cluster_index}
    path_key = GH_Path(group_id, cluster_idx)

    # hull -> polyline (meters)
    hull_raw = c.get("hull_3d", [])
    pts = []
    if isinstance(hull_raw, list):
        for h in hull_raw:
            pt, _ = _coerce_point3d(h)
            if pt is not None:
                pts.append(pt)

    plc_m = _make_polylinecurve(pts, make_closed)
    plc_mm = _to_mm_curve(plc_m) if (plc_m is not None and plc_m.IsValid) else None
    if plc_mm is not None and plc_mm.IsValid:
        Polylines.Add(plc_mm, path_key)
        made_pl += 1

    # centroid (meters -> mm)
    cent_raw = c.get("centroid_3d", None)
    if cent_raw is not None:
        cpt_m, _ = _coerce_point3d(cent_raw)
        cpt_mm = _to_mm_point(cpt_m)
        if cpt_mm is not None:
            Centroids.Add(cpt_mm, path_key)
            made_cent += 1

    # mean color (unitless)
    mean_rgb = cg.get("group_mean_rgb", None)
    col = _rgb_to_color(mean_rgb) if mean_rgb is not None else None
    if col is not None:
        MeanColors.Add(col, path_key)
        made_color += 1

# ---------- summary ----------
Info = "File: {} | Clusters: {} | Polylines(mm): {} | Centroids(mm): {} | MeanColors: {} | source_units: {}".format(
    os.path.basename(path), len(clusters), made_pl, made_cent, made_color, units_in
)
# ---------- end py3_2 ----------
panel_13 = Panel(py3_2.Info)
crv_4 = Curve(py3_2.Polylines)
cset = CreateSet(List=flatten(py3_2.MeanColors))  # -> Set, graft(Map)
lng_5 = ListLength(List=crv_4)
series_2 = Series(Start=0, Step=1, Count=lng_5)  # -> graft(Series)

# ----
area_4 = Area(Geometry=flatten(crv_4))  # -> Area, Centroid
avr_3 = Average(Input=area_4.Centroid)
project = Project(Geometry=crv_4, Plane=area_4.Centroid)  # -> Geometry, Transform

# ---- group: Import and turn into content (continued)
srf = Surface(graft(project.Geometry))
preview_2 = CustomPreview(Geometry=srf, Material=graft(py3_2.MeanColors))

graft = GraftTree(Tree=py3_2.MeanColors, IncludeEmptyLists=True, IncludeNullItems=True)
merge_4 = Merge(Data1=simplify(series_2), Data2=simplify(cset.Map), Data3=simplify(graft))

u_text_2 = UserText(Content=graft(srf), Keys=merge, Values=merge_4, UserTextMode=1)  # -> simplify(Content), Keys, Values

# ----
panel_14 = Panel(u_text_2.Values)

# ---- group: you need to use data container to carry CONTENT
data = Data(u_text_2.Content)

# ----
u_text_3 = UserText(Content=data, Keys="color", UserTextMode=1)  # -> simplify(Content), Keys, Values
crv_5 = Curve(u_text_3.Content)
preview_3 = CustomPreview(Geometry=crv_5, Material=u_text_3.Values)

u_text_4 = UserText(Content=flatten(data), Keys="Category", UserTextMode=1)  # -> simplify(Content), Keys, Values
crv_6 = Curve(u_text_4.Content)

# ---- group: Replace a path by another
path_to_overwrite = Data(u_text_4.Values)
data_2 = Data(graft(u_text_4.Content))
tree_statistics = TreeStatistics(Tree=data_2)  # -> Paths, Length, Count
replace_text = ReplaceText(Text=path_to_overwrite, Find=",", Replace=";", RecursiveReplace=False)
replace_paths = ReplacePaths(Data=data_2, Search=tree_statistics.Paths, Replace=flatten(replace_text))
data_3 = Data(replace_paths)

# ----
lng_6 = ListLength(List=data_3)  # -> flatten(Length)
rep = ReplaceText(Text=panel_2, Find=panel_3, Replace=lng_6, RecursiveReplace=False)
panel_15 = Panel(rep)
join_2 = TextJoin(Text=rep)
bang = ExplodeTree(Data=data_3)  # -> Branch0, Branch1, Branch2
data_4 = Data(flatten(u_text_4.Content))
original_shapes = Data(flatten(data_4))

crv_7 = Curve(rec_3pt.Rectangle)
area_5 = Area(Geometry=crv_7)  # -> Area, Centroid

spacing_from_boundary = Slider(10, range=0..30)
crv_8 = Curve(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)
neg_5 = Negative(Value=spacing_from_boundary)

area_6 = Area(Geometry=crv_8)  # -> Area, Centroid
vec2pt_2 = Vector2Pt(PointA=area_6.Centroid, PointB=area_5.Centroid, Unitize=False)  # -> Vector, Length
move_2 = Move(Geometry=crv_8, Motion=vec2pt_2.Vector)  # -> Geometry, Transform

boundary = BoundarySurfaces(Edges=reparameterize(move_2.Geometry))

offset = OffsetCurve(Curve=move_2.Geometry, Distance=neg_5, Corners=1)  # -> flatten(Curve)

srf_2 = Surface(boundary)
srf_3 = Surface(boundary)

# ---- group: generate 3 zones
pt_10 = Point(Point(21.27754284, 463.8587945, 0))
pt_11 = Point(Point(468.0654869, 457.7664293, 0))
pt_12 = Point(Point(237.8899813, 26.09482622, 0))
divide = DivideDomain²(Domain=srf_3, UCount=Slider(15, range=0..100), VCount=Slider(15, range=0..100))
merge_5 = Merge(Data1=pt_10, Data2=pt_11, Data3=pt_12)
subsrf = Isotrim(Surface=srf_3, Domain=flatten(divide))  # -> graft(Surface)
lng_7 = ListLength(List=merge_5)
area_7 = Area(Geometry=subsrf)  # -> Area, Centroid
dist = Distance(PointA=graft(area_7.Centroid), PointB=merge_5)
series_3 = Series(Start=0, Step=1, Count=lng_7)

tstat = TreeStatistics(Tree=dist)  # -> Paths, Length, Count
series_4 = Series(Start=0, Step=1, Count=tstat.Count)  # -> graft(Series)
lng_8 = ListLength(List=dist)
random_8 = Random(Range=Slider(148, range=0..200), Number=lng_8, Seed=series_4)  # -> simplify(Random)
addition = Addition(A=dist, B=random_8)

sort_2 = SortList(Keys=addition, ValuesA=series_3)  # -> Keys, ValuesA
item = ListItem(List=sort_2.ValuesA, Index=0, Wrap=True)
equals = Equality(FirstNumber=item, SecondNumber="0")  # -> Equality, Inequality
equals_2 = Equality(FirstNumber=item, SecondNumber="1")  # -> Equality, Inequality
equals_3 = Equality(FirstNumber=item, SecondNumber="2")  # -> Equality, Inequality
cull = CullPattern(List=subsrf, CullPattern=equals.Equality)
cull_2 = CullPattern(List=subsrf, CullPattern=equals_2.Equality)
cull_3 = CullPattern(List=subsrf, CullPattern=equals_3.Equality)

# ---- group: build opennest paritions
entwine = Entwine(Branch00=cull, Branch01=cull_2, Branch02=cull_3, FlattenInputs=True)
join_3 = BrepJoin(Breps=entwine)  # -> Breps, Closed
fmerge = MergeFaces(Brep=join_3.Breps)  # -> Breps, Before, After
offset_2 = OffsetCurve(Curve=entwine, Distance=Slider(3, range=0..10), Corners=1)
pshift = ShiftPaths(Data=offset_2, Offset=-1)
runion = RegionUnion(Curves=pshift)
boundary_2 = BoundarySurfaces(Edges=runion)

# ----
panel_17 = Panel(runion)

area_8 = Area(Geometry=boundary_2)  # -> Area, Centroid
sort_3 = SortList(Keys=area_8.Area, ValuesA=boundary_2)  # -> Keys, reverse(ValuesA)

srf_4 = Surface(simplify(sort_3.ValuesA))

Z_2 = UnitZ(Factor=1)

# ---- group: split surface into area
boundary_3 = BoundarySurfaces(Edges=reparameterize(offset))

# ----
project_2 = ProjectCurve(Curve=topoly.Polyline, Brep=boundary_3, Direction=Z_2)

# ---- group: split surface into area (continued)
srfsplit = SurfaceSplit(Surface=boundary_3, Curves=flatten(project_2))  # -> simplify(Fragments)
item_2 = CherryPicker(srfsplit, ListIndex=2)
item_3 = ListItem(List=flatten(srfsplit), Index=0, Wrap=invert(True))  # -> Item, Item1, Item2, Item3, Item4, Item5
entwine_2 = Entwine(Branch00=item_3.Item1, Branch01=item_3.Item, Branch02=item_3.Item2, FlattenInputs=True)  # -> simplify(Result)
srf_5 = Surface(simplify(entwine_2))

area_9 = Area(Geometry=srf_5)  # -> Area, Centroid
sort_4 = SortList(Keys=area_9.Area, ValuesA=srf_5)  # -> Keys, reverse(ValuesA)

srf_6 = Surface(simplify(sort_4.ValuesA))

# ---- group: here insert your surface grafted in 3 branches, one per color
srf_7 = Surface(srf_6)

# ----
bang_2 = ExplodeTree(Data=srf_7)  # -> Branch0, Branch1, Branch2

# ---- group: I know
toggle = BooleanToggle(True)
geometry = Geometry(Outlines=bang.Branch0, Simplify=-100, Hull=invert(False))  # -> Geometry, Borders
geometry_2 = Geometry(Outlines=bang.Branch1, Simplify=-100, Hull=invert(False))  # -> Geometry, Borders
geometry_3 = Geometry(Outlines=bang.Branch2, Simplify=-100, Hull=invert(False))  # -> Geometry, Borders
sheets_srf = SheetsSrf(Surfaces=bang_2.Branch0, Gap=0.1, Count=1)  # -> Sheets, Polylines
sheets_srf_2 = SheetsSrf(Surfaces=bang_2.Branch1, Gap=0.1, Count=1)  # -> Sheets, Polylines
sheets_srf_3 = SheetsSrf(Surfaces=bang_2.Branch2, Gap=0.1, Count=1)  # -> Sheets, Polylines
opennest2 = OpenNest2(Sheets=sheets_srf.Sheets, Geometry=geometry.Geometry, Options=nest_options, Iterations=1, Run=toggle)  # -> Sheets, Borders, AllGeometry, Transforms, SheetId, SheetTxt, Attributes
opennest2_2 = OpenNest2(Sheets=sheets_srf_2.Sheets, Geometry=geometry_2.Geometry, Options=nest_options, Iterations=1, Run=toggle)  # -> Sheets, Borders, AllGeometry, Transforms, SheetId, SheetTxt, Attributes
opennest2_3 = OpenNest2(Sheets=sheets_srf_3.Sheets, Geometry=geometry_3.Geometry, Options=nest_options, Iterations=1, Run=toggle)  # -> Sheets, Borders, AllGeometry, Transforms, SheetId, SheetTxt, Attributes

# ----
entwine_3 = Entwine(Branch00=opennest2.AllGeometry, Branch01=opennest2_2.AllGeometry, Branch02=opennest2_3.AllGeometry, FlattenInputs=True)  # -> simplify(Result)
entwine_4 = Entwine(Branch00=opennest2.SheetId, Branch01=opennest2_2.SheetId, Branch02=opennest2_3.SheetId, FlattenInputs=True)  # -> simplify(Result)

equals_4 = Equality(FirstNumber=entwine_4, SecondNumber="-1")  # -> Equality, Inequality

# ---- group: replace curves but keep info
cull_4 = CullPattern(List=entwine_3, CullPattern=invert(equals_4.Equality))  # -> graft(List)
cull_5 = CullPattern(List=data_3, CullPattern=invert(equals_4.Equality))  # -> graft(List)
u_text_5 = UserText(Content=cull_5, UserTextMode=0)  # -> simplify(Content), Keys, Values

# ----
project_3 = Project(Geometry=cull_4, Plane=area_5.Centroid)  # -> Geometry, Transform

# ---- group: replace curves but keep info (continued)
u_text_6 = UserText(Content=project_3.Geometry, Keys=u_text_5.Keys, Values=u_text_5.Values, UserTextMode=0)  # -> simplify(Content), Keys, Values

# ----
u_text_7 = UserText(Content=u_text_6.Content, Keys="indices", UserTextMode=1)  # -> Content, Keys, Values
area_10 = Area(Geometry=u_text_7.Content)  # -> Area, Centroid
tag = TextTag(Location=area_10.Centroid, Text=u_text_7.Values)

crv_9 = Curve(u_text_6.Content)

u_text_8 = UserText(Content=u_text_6.Content, UserTextMode=1)  # -> Content, Keys, Values
boundary_4 = Curve(srf_2)
boundary_no_offset = Curve(srf_2)
inside_boundaries = Curve(offset)

# ---- group: subdivide shape into precise division
crv_10 = Curve(u_text_8.Content)

# ----
explode_2 = Explode(Curve=crv_10, Recursive=True)  # -> Segments, Vertices
disc_2 = Discontinuity(Curve=crv_10, Level=1)  # -> Points, Parameters

pcen = PolygonCenter(Polyline=graft(crv_10))  # -> CenterV, CenterE, CenterA

explode_3 = Explode(Curve=crv_10, Recursive=True)  # -> Segments, Vertices
area_11 = Area(Geometry=crv_10)  # -> Area, flatten(Centroid)

pt_13 = Point(flatten(pcen.CenterV))
anchor = Anchor(Point=pt_13, Target=pt_13, Strength=Slider(0.471, range=0..1))

prox = Proximity2D(Points=area_11.Centroid, Plane=PlaneXY(0, 0, 0), Group=5)  # -> flatten(Links), Topology

# ---- group: Check colision and avoid overlap
line = Line(explode_3.Segments)
collider = Collider(Objects=flatten(line), Radii=radii, Strength="1000")

# ---- group: keep in the frame
mesh_2 = Mesh(inside_boundaries)
mjoin_2 = MeshJoin(Meshes=mesh_2)
onmesh = OnMesh(Points=flatten(disc_2.Points), Mesh=mjoin_2, Strength="1000")

# ----
explode_4 = Explode(Curve=crv_10, Recursive=True)  # -> Segments, Vertices

rigidpointset = RigidPointSet(Points=pcen.CenterV, Plane=pcen.CenterV, Strength=Slider(1, range=0..1))  # -> RigidBody, Planes

# ---- group: Keep each individual shape strongly attached of each center
inter = InterconnectPoints(Pts=flatten(area_11.Centroid))
length_line = LengthLine(Line=inter, Strength="-500")

inter_2 = InterconnectPoints(Pts=disc_2.Points)
length_line_2 = LengthLine(Line=inter_2, Strength="1000")

# ----
shift = ShiftList(List=explode_4.Segments, Shift=1, Wrap=True)

# ---- group: keep everything on the plane
pt_14 = Point(disc_2.Points)
anchorxyz = AnchorXYZ(Point=flatten(pt_14), X=False, Y=False, Z=invert(False), Strength="1000")

# ----
angle = Angle(LineA=explode_4.Segments, LineB=shift, Strength=Slider(1000, range=0..1000))  # -> flatten(Angle)
rigidpointset_2 = RigidPointSet(Points=disc_2.Points, Strength=10)  # -> RigidBody, Planes; disabled
cc = CurveCollide(Curves=flatten(crv_10), PassiveCurves=boundary_4, BasePlane=PlaneXY(0, 0, 0), Strength=Slider(0.329, range=0..1))  # -> Goal, Frames

# ---- group: keep track of the shape for display
show = Show(G=flatten(crv_10))

# ----
brec = BoundingRectangle(Geometry=u_text_8.Content, Plane=PlaneXY(0, 0, 0), Axis=0, Slide=0, Union=True)  # -> Bounding, DimensionX, DimensionY
area_12 = Area(Geometry=brec.Bounding)  # -> Area, Centroid
ma = MassAddition(Input=flatten(area_12.Area))  # -> Result, PartialResults
dam = DataDam(DataA=ma.Result, BufferDelay=5000000, BufferMode=2)
equals_5 = Equality(FirstNumber=ma.Result, SecondNumber=dam)  # -> Equality, Inequality
or = GateOr(A=equals_5.Inequality, B=reset)

entwine_5 = Entwine(
    Branch00=show,
    Branch01=flatten([collider, anchorxyz, length_line_2, anchor, rigidpointset.RigidBody, onmesh, length_line, cc.Goal, rigidpointset_2.RigidBody, grab, angle]),
    FlattenInputs=True)
solver = Solver(GoalObjects=entwine_5, Reset=or, Threshold=list, Tolerance=list_2, On=on)  # -> I, V, O
bang_3 = ExplodeTree(Data=solver.O)  # -> Branch0, Branch1
panel_18 = Panel(equals_5.Inequality)
crv_11 = Curve(graft(bang_3.Branch0))  # disabled
geo_2 = Geometry(bang_3.Branch0)
data_5 = Data(geo_2)

# ---- group: replace curves but keep info
u_text_9 = UserText(Content=u_text_8.Content, UserTextMode=0)  # -> simplify(Content), Keys, Values

# ----
match = MatchTree(Tree=graft(data_5), Guide=u_text_9.Content)
u_text_10 = UserText(Content=match, Keys=u_text_9.Keys, Values=u_text_9.Values, UserTextMode=0)  # -> simplify(Content), Keys, Values
filter = StreamFilter(Gate=bypass_kangaroo, Stream0=u_text_10.Content, Stream1=u_text_8.Content)
u_text_11 = UserText(Content=filter, UserTextMode=0)  # -> simplify(Content), Keys, Values
item_4 = ListItem(List=u_text_11.Values, Index=0, Wrap=True)  # -> Item, Item1, Item2, Item3
panel_19 = Panel(item_4.Item)
panel_20 = Panel(item_4.Item1)
panel_21 = Panel(item_4.Item2)
panel_22 = Panel(item_4.Item3)
boundary_5 = BoundarySurfaces(Edges=u_text_11.Content)
preview_4 = CustomPreview(Geometry=boundary_5, Material=panel_21)
item_5 = ListItem(List=original_shapes, Index=item_4.Item, Wrap=True)
area_13 = Area(Geometry=item_5)  # -> Area, Centroid
area_14 = Area(Geometry=boundary_5)  # -> Area, Centroid

vec2pt_3 = Vector2Pt(PointA=flatten(area_13.Centroid), PointB=flatten(area_14.Centroid), Unitize=False)  # -> Vector, Length
move_3 = Move(Geometry=flatten(item_5), Motion=vec2pt_3.Vector)  # -> Geometry, Transform

crv_12 = Curve(item_5)

# ---- group: find angle
planar = Planar(Curve=move_3.Geometry)  # -> Planar, Plane, Deviation
planar_2 = Planar(Curve=u_text_11.Content)  # -> Planar, Plane, Deviation
pl_origin = PlaneOrigin(Base=planar.Plane, Origin=flatten(area_14.Centroid))
pl_origin_2 = PlaneOrigin(Base=flatten(planar_2.Plane), Origin=flatten(area_14.Centroid))
orient = Orient(Geometry=move_3.Geometry, Source=pl_origin, Target=pl_origin_2)  # -> Geometry, Transform

# ----
planar_3 = Planar(Curve=flatten(item_5))  # -> Planar, Plane, Deviation
pln = Plane(planar_3.Plane)
pln_2 = Plane(pl_origin)
crv_13 = Curve(geo_2)

number_slider_20 = Slider(10, range=0..10)
ln = Line(StartPoint=pln, EndPoint=pln_2)
swatch_5 = ColourSwatch(SwatchColor=RGB(191, 191, 191))
dash = DashPattern(Curve=[original_shapes, boundary_no_offset, inside_boundaries, crv_13], Pattern=number_slider_20)  # -> Dashes, Gaps
dash_2 = DashPattern(Curve=ln, Pattern=number_slider_20)  # -> Dashes, Gaps; disabled
preview_5 = CustomPreview(Geometry=[dash.Dashes, dash_2.Dashes], Material=swatch_5)

dash_3 = DashPattern(Curve=original_shapes, Pattern=number_slider_20)  # -> Dashes, Gaps
preview_6 = CustomPreview(Geometry=dash_3.Dashes, Material=swatch_5)

boundary_6 = BoundarySurfaces(Edges=graft(item_5))
area_15 = Area(Geometry=boundary_6)  # -> Area, Centroid
# Design & Packing
preview_7 = CustomPreview(Geometry=boundary_6, Material=panel_21)
tag_2 = TextTag(Location=area_15.Centroid, Text=item_4.Item, Colour=swatch_2)

crv_14 = Curve(u_text_11.Content)
crv_15 = Curve(item_5)
crv_16 = Curve(item_5)
crv_17 = Curve(u_text_11.Content)
item_6 = ListItem(List=flatten(crv_16), Index=0, Wrap=True)

u_text_12 = UserText(Content=u_text_6.Content, Keys="color", UserTextMode=1)  # -> Content, Keys, Values

srf_8 = Surface(u_text_12.Content)

preview_8 = CustomPreview(Geometry=srf_8, Material=u_text_12.Values)

crv_18 = Curve(u_text_11.Content)
crv_19 = Curve(move_3.Geometry)
disc_3 = Discontinuity(Curve=crv_18, Level=1)  # -> Points, Parameters
disc_4 = Discontinuity(Curve=crv_19, Level=1)  # -> Points, Parameters
explode_5 = Explode(Curve=crv_18, Recursive=True)  # -> Segments, Vertices
explode_6 = Explode(Curve=crv_19, Recursive=True)  # -> Segments, Vertices
avr_4 = Average(Input=disc_3.Points)
avr_5 = Average(Input=disc_4.Points)
len = Length(Curve=explode_5.Segments)
len_2 = Length(Curve=explode_6.Segments)
sort_5 = SortList(Keys=len, ValuesA=explode_5.Segments)  # -> Keys, ValuesA
sort_6 = SortList(Keys=len_2, ValuesA=explode_6.Segments)  # -> Keys, ValuesA
item_7 = ListItem(List=reverse(sort_6.Keys), Index=0, Wrap=True)

multiplication = Multiplication(A=item_7, B="1.5")

# ---- group: delete kangaroo bugs
larger = LargerThan(FirstNumber=multiplication, SecondNumber=sort_5.ValuesA)  # -> LargerThan, OrEqualTo
cull_6 = CullPattern(List=sort_5.ValuesA, CullPattern=larger.LargerThan)
len_3 = Length(Curve=cull_6)
sort_7 = SortList(Keys=len_3, ValuesA=cull_6)  # -> Keys, ValuesA

# ----
item_8 = ListItem(List=reverse(sort_6.ValuesA), Index=0, Wrap=True)

end = EndPoints(Curve=item_8)  # -> Start, End
Z_3 = UnitZ(Factor=1)
pl = PlaneNormal(Origin=end.Start, ZAxis=Z_3)
align = AlignPlane(Plane=pl, Direction=item_8)  # -> Plane, Angle

pln_3 = Plane(align.Plane)

explode_7 = Explode(Curve=crv_12, Recursive=True)  # -> Segments, Vertices
len_4 = Length(Curve=explode_7.Segments)
sort_8 = SortList(Keys=len_4, ValuesA=explode_7.Segments)  # -> Keys, ValuesA
item_9 = ListItem(List=reverse(sort_8.ValuesA), Index=0, Wrap=True)

end_2 = EndPoints(Curve=item_9)  # -> Start, End
Z_4 = UnitZ(Factor=1)
pl_2 = PlaneNormal(Origin=end_2.Start, ZAxis=Z_4)
align_2 = AlignPlane(Plane=pl_2, Direction=item_9)  # -> Plane, Angle

# ---- group: picking planes
area_16 = Area(Geometry=crv_12)  # -> Area, Centroid
pl_origin_3 = PlaneOrigin(Base=align_2.Plane, Origin=area_16.Centroid)

# ----
lnpt = LinePt(Line=item_9, Point=area_16.Centroid)  # disabled

pick_plane = Plane(pl_origin_3)
xy_5 = XYPlane(Origin=pick_plane)
pflip_2 = FlipPlane(Plane=xy_5, ReverseX=False, ReverseY=False, SwapAxes=True)

xy_6 = XYPlane(Origin=Point(0, 0, 0))
deplane = DeconstructPlane(Plane=pflip_2)  # -> Origin, XAxis, YAxis, ZAxis
vec2pt_4 = Vector2Pt(PointA=deplane.Origin, PointB=xy_6, Unitize=False)  # -> Vector, Length
pl_3 = ConstructPlane(Origin=deplane.Origin, XAxis=vec2pt_4.Vector, YAxis=deplane.YAxis)

rotate = Rotate(Geometry=pflip_2, Angle=degrees(number_slider_14), Plane=xy_5)  # -> Geometry, Transform
project_4 = Project(Geometry=xy_6, Plane=deplane.Origin)  # -> Geometry, Transform
ln_2 = Line(StartPoint=deplane.Origin, EndPoint=project_4.Geometry)
rotate_2 = Rotate(Geometry=pflip_2, Angle=degrees(number_slider_14), Plane=xy_5)  # -> Geometry, Transform
align_3 = AlignPlane(Plane=pflip_2, Direction=ln_2)  # -> Plane, Angle
xy_7 = XYPlane(Origin=rotate_2.Geometry)

item_10 = ListItem(List=reverse(sort_7.ValuesA), Index=0, Wrap=True)
lnpt_2 = LinePt(Line=item_10, Point=avr_4)  # disabled
lnpt_3 = LinePt(Line=item_8, Point=avr_5)  # disabled

end_3 = EndPoints(Curve=item_10)  # -> Start, End
Z_5 = UnitZ(Factor=1)
pl_4 = PlaneNormal(Origin=end_3.Start, ZAxis=Z_5)
align_4 = AlignPlane(Plane=pl_4, Direction=item_10)  # -> Plane, Angle

pln_4 = Plane(align_4.Plane)

orient_2 = Orient(Geometry=graft(crv_19), Source=align.Plane, Target=align_4.Plane)  # -> Geometry, Transform

# ---- group: visualize
boundary_7 = BoundarySurfaces(Edges=graft(orient_2.Geometry))
area_17 = Area(Geometry=boundary_7)  # -> Area, Centroid
preview_9 = CustomPreview(Geometry=boundary_7, Material=panel_21)
tag_3 = TextTag(Location=area_17.Centroid, Text=item_4.Item, Colour=swatch_2)

# ---- group: placing plane
area_18 = Area(Geometry=crv_18)  # -> Area, Centroid
pl_origin_4 = PlaneOrigin(Base=align_4.Plane, Origin=area_18.Centroid)

# ----
placing_plane = Plane(pl_origin_4)
points = PointList(Points=flatten(placing_plane), Size=Slider(10, range=0..10))
pl_origin_5 = PlaneOrigin(Base=placing_plane, Origin=pick_plane)
pl_origin_6 = PlaneOrigin(Base=rotate_2.Geometry, Origin=placing_plane)
deplane_2 = DeconstructPlane(Plane=pl_origin_6)  # -> Origin, XAxis, YAxis, ZAxis
line_2 = LineSDL(Start=deplane_2.Origin, Direction=deplane_2.XAxis, Length=number_slider_15)
end_4 = EndPoints(Curve=line_2)  # -> Start, End

# ---- group: plane deviation in degrees
pl_origin_7 = PlaneOrigin(Base=placing_plane, Origin=pick_plane)
deplane_3 = DeconstructPlane(Plane=pl_origin_7)  # -> Origin, XAxis, YAxis, ZAxis
deplane_4 = DeconstructPlane(Plane=pick_plane)  # -> Origin, XAxis, YAxis, ZAxis

# ----
xy_8 = XYPlane(Origin=pl_origin_7)

# ---- group: plane deviation in degrees (continued)
angle_2 = Angle(VectorA=deplane_3.XAxis, VectorB=deplane_4.XAxis, Plane=xy_8)  # -> Angle, Reflex
deg = Degrees(Radians=angle_2.Angle)

# ----
neg_6 = Negative(Value=angle_2.Reflex)
larger_2 = LargerThan(FirstNumber=deg, SecondNumber=Slider(180, range=0..1000))  # -> LargerThan, OrEqualTo
deg_2 = Degrees(Radians=neg_6)
p_n_c_2 = PickNChoose(Pattern=larger_2.LargerThan, Stream0=deg, Stream1=deg_2)  # -> simplify(Result)
division = Division(A=p_n_c_2, B=Slider(2, range=0..10))
neg_7 = Negative(Value=division)
rotate_3 = Rotate(Geometry=rotate_2.Geometry, Angle=degrees(neg_7), Plane=rotate_2.Geometry)  # -> Geometry, Transform
rotate_4 = Rotate(Geometry=pl_origin_6, Angle=degrees(p_n_c_2), Plane=pl_origin_6)  # -> Geometry, Transform
rotate_5 = Rotate(Geometry=pl_origin_6, Angle=degrees(division), Plane=pl_origin_6)  # -> Geometry, Transform
pln_5 = Plane(rotate_3.Geometry)
pln_6 = Plane(rotate_5.Geometry)
deplane_5 = DeconstructPlane(Plane=pln_6)  # -> Origin, XAxis, YAxis, ZAxis
xy_9 = XYPlane(Origin=rotate_4.Geometry)
pv = PlaneVisualizer(Plane=pln_5)
line_3 = LineSDL(Start=deplane_5.Origin, Direction=deplane_5.XAxis, Length=number_slider_15)

# ---- group: golden
orient_3 = Orient(Geometry=crv_15, Source=pln_5, Target=pln_6)  # -> Geometry, Transform

# ----
deplane_6 = DeconstructPlane(Plane=pln_6)  # -> Origin, XAxis, YAxis, ZAxis
deplane_7 = DeconstructPlane(Plane=pln_5)  # -> Origin, XAxis, YAxis, ZAxis
end_5 = EndPoints(Curve=line_3)  # -> Start, End
pv_2 = PlaneVisualizer(Plane=pln_6)
multiplication_2 = Multiplication(A=deg, B=number_slider_16)
multiplication_3 = Multiplication(A=deg, B=subtraction)
line_4 = LineSDL(Start=deplane_7.Origin, Direction=deplane_7.XAxis, Length=number_slider_15)
line_5 = LineSDL(Start=deplane_6.Origin, Direction=deplane_6.XAxis, Length=number_slider_15)
angledim = AngularDimension(Center=end_4.Start, PointA=end_4.End, PointB=end_5.End, Reflex=False, Text="{0:0.0}°", Size=1)
place = Plane(simplify(pln_6))
pick = Plane(simplify(pln_5))
item_11 = ListItem(List=flatten(pick), Index=0, Wrap=True)
lng_9 = ListLength(List=pick)
repeat = RepeatData(Data=pflip, Length=lng_9)  # -> simplify(Data)
move_4 = Move(Geometry=pick, Motion=Z)  # -> Geometry, Transform

# ---- group: Extrusion On
panel_23 = Panel("4")
panel_24 = Panel("0")
setdo = SetDO(DO=panel_23, Value="TRUE")
setdo_2 = SetDO(DO=panel_24, Value="TRUE")
merge_6 = Merge(Data1=wait, Data2=setdo_2, Data3=wait)
groupcmd = GroupCommand(Commands=merge_6)
list_5 = ValueList({"Joint", "Linear"}, selected="Linear")
target_2 = CreateTarget(
    Plane=move_4.Geometry,
    RobConf=list_4,
    Motion=list_5,
    Tool=tool.Tool,
    Speed=number_slider_17,
    Zone="5",
    Command=groupcmd,
    IsCartesian=True)

# ---- group: Extrusion Off
setdo_3 = SetDO(DO=panel_23, Value="False")
setdo_4 = SetDO(DO=panel_24, Value="False")
merge_7 = Merge(Data1=wait, Data2=setdo_4, Data3=wait)
groupcmd_2 = GroupCommand(Commands=merge_7)
list_6 = ValueList({"Joint", "Linear"}, selected="Linear")
target_3 = CreateTarget(
    Plane=place,
    RobConf=list_4,
    Motion=list_6,
    Tool=tool.Tool,
    Speed=number_slider_17,
    Zone="5",
    Command=groupcmd_2,
    IsCartesian=True)

# ---- group: Ending Offset
pl_offset = PlaneOffset(BasePlane=place, Offset=clearence_plane)
list_7 = ValueList({"Joint", "Linear"}, selected="Joint")
target_4 = CreateTarget(Plane=pl_offset, RobConf=list_4, Motion=list_7, Tool=tool.Tool, Speed=number_slider_17, Zone="5", IsCartesian=True)

# ----
pl_offset_2 = PlaneOffset(BasePlane=place, Offset=clearence_plane)
list_8 = ValueList({"Joint", "Linear"}, selected="Linear")
target_5 = CreateTarget(Plane=pl_offset_2, RobConf=list_4, Motion=list_8, Tool=tool.Tool, Speed=number_slider_17, Zone="5", IsCartesian=True)
renumber = RenumberPaths(Data=target_5)

# ---- group: Starting Offset
pl_offset_3 = PlaneOffset(BasePlane=move_4.Geometry, Offset=clearence_plane)
list_9 = ValueList({"Joint", "Linear"}, selected="Joint")
target_6 = CreateTarget(Plane=pl_offset_3, RobConf=list_4, Motion=list_9, Tool=tool.Tool, Speed=null, Zone="5", IsCartesian=True)

# ---- group: Main Code
list_10 = ValueList({"Joint", "Linear"}, selected="Joint")
target_7 = CreateTarget(Plane=repeat, RobConf=list_4, Motion=list_10, Tool=tool.Tool, Speed=number_slider_17, Zone="5", IsCartesian=True)

# ----
renumber_2 = RenumberPaths(Data=target_4)
renumber_3 = RenumberPaths(Data=target_3)
renumber_4 = RenumberPaths(Data=target_6)
renumber_5 = RenumberPaths(Data=target_2)
renumber_6 = RenumberPaths(Data=target_7)

merge_8 = Merge(
    Data1=simplify(renumber_4),
    Data2=simplify(renumber_5),
    Data3=simplify(renumber_6),
    Data4=simplify(renumber_2),
    Data5=simplify(renumber_3),
    Data6=simplify(renumber),
    Data7=simplify(renumber_6))
panel_25 = Panel(merge_8)
entwine_6 = Entwine(Branch00=target, Branch01=merge_8, Branch02=target, FlattenInputs=True)
program = CreateProgram(Name=name_of_the_program, RobotSystem=load_robot, Targets1=flatten(entwine_6), StepSize=1)  # -> Program, Code, Duration, Warnings, Errors
check_errors = Panel(program.Errors)
to_export_code_to_prg_file = Panel(program.Code)

# ---- group: Code to Export
data_6 = Data(program.Code)
trim = TrimTree(Tree=data_6, Depth=expr("2", 1))
graft_2 = GraftTree(Tree=trim, IncludeEmptyLists=True, IncludeNullItems=True)  # -> simplify(Tree)
panel_26 = Panel("""-1
0""")
cull_i = CullIndex(List=flatten(graft_2), Indices=panel_26, Wrap=True)

# ----
sim = ProgramSimulation(Program=program.Program, Time=number_slider_13, Normalized=True)  # -> SystemMeshes, JointRotations, Plane, Index, Time, Program, Errors
subtraction_2 = Subtraction(A=sim.Index, B=1)
item_12 = ListItem(List=sim.Plane, Index=7, Wrap=True)
division_2 = Division(A=subtraction_2, B=Slider(7, range=0..10))
item_13 = ListItem(List=flatten(entwine_6), Index=division_2, Wrap=True)
deconstructtoolpath = DeconstructToolpath(Toolpath=item_13)
panel_27 = Panel(division_2)
detarget = DeconstructTarget(Target=deconstructtoolpath)
round_2 = Round(Number=division_2)  # -> Nearest, Floor, Ceiling
detarget_2 = DeconstructTarget(Target=item_13)  # -> Joints, Plane, Tool, Command
item_14 = ListItem(List=flatten(crv_16), Index=round_2.Floor, Wrap=True)
panel_28 = Panel(detarget_2.Tool)
item_15 = ListItem(List=flatten(panel_19), Index=round_2.Floor, Wrap=True)
item_16 = ListItem(List=flatten(panel_21), Index=round_2.Floor, Wrap=True)
item_17 = ListItem(List=flatten(pick), Index=round_2.Floor, Wrap=True)
orient_4 = Orient(Geometry=item_14, Source=item_17, Target=item_12)  # -> Geometry, Transform
srf_9 = Surface(orient_4.Geometry)
area_19 = Area(Geometry=srf_9)  # -> Area, Centroid
preview_10 = CustomPreview(Geometry=srf_9, Material=item_16)
tag_4 = TextTag(Location=area_19.Centroid, Text=item_15)
panel_29 = Panel(round_2.Floor)
item_18 = ListItem(List=sim.Plane, Index=0, Wrap=True)  # -> Item1, Item
pv_3 = PlaneVisualizer(Plane=item_18.Item1)

# ---- group: printing time
division_3 = Division(A=program.Duration, B=60)
round_3 = Round(Number=division_3)  # -> Nearest, Floor, Ceiling
time_in_minutes = Panel(round_3.Nearest)

# ---- group: Display Data
trail = SimpleTrail(Program=sim.Program, Length="20000", MechanicalGroup=0)
split = SplitList(List=sim.SystemMeshes, Index="7")  # -> ListA, ListB
preview_11 = CustomPreview(Geometry=trail, Material=ColourSwatch(SwatchColor=RGB(255, 0, 195)))
preview_12 = CustomPreview(Geometry=split.ListA, Shader=ColourSwatch(SwatchColor=RGB(219, 219, 219)))
preview_13 = CustomPreview(Geometry=split.ListB, Shader=ColourSwatch(SwatchColor=RGBA(168, 168, 168, 150)))

# ---- group: exporting the file
file_name = Panel("test01")
txt = Text(flatten(cull_i))
path_2 = FilePath("D:\\")
python = GhPythonScript(program=txt, path=path_2, name=file_name, write=Button())  # -> out, a; inputs program: list
# ---------- python: Python ----------
__author__ = "Ric M"
__version__ = "2023.03.16"

import rhinoscriptsyntax as rs

if write:
    with open(path + name + '.script', 'w') as file:
        for line in program:
            file.write(line)
            file.write('\n')
# ---------- end python ----------

# ----
remote = RemoteConnection(Program=sim.Program, IP=panel_7, Upload=button, Play=button_2, Pause=button_3)
# TOOLPATH
# PROGRAM
to_export_code_to_prg_file_2 = Panel(txt)
