# Grasshopper definition robotic fabrication example.gh (Grasshopper 1.0.8)
# plug-ins: Robots, MetaHopper

# ---- group: Tool Mesh / Camera & Motor Screw 02
brep = Brep([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])
join = BrepJoin(Breps=brep)  # -> Breps, Closed
mesh = Mesh(join.Breps)
number_slider = Slider(180, range=-180..180)
mjoin = MeshJoin(Meshes=mesh)
rot3d = Rotate3D(Geometry=mjoin, Angle=degrees(number_slider), Center=Point(0, 0, 0), Axis=Vector(0, 0, 1))  # -> Geometry, Transform

# ---- group: TCP Points
default_tcp_sprint = Point(Point(186.4320426, -0.0001053250157, 74.40559159))  # disabled

# ---- group: TCP Points / pointer
neg = Negative(Value="1.86")
pt = ConstructPoint(XCoordinate=neg, YCoordinate="3.12", ZCoordinate="133.15")
pt_2 = Point(pt)
rot3d_2 = Rotate3D(Geometry=pt_2, Angle=degrees(number_slider), Center=Point(0, 0, 0), Axis=Vector(0, 0, 1))  # -> Geometry, Transform

# ---- group: Position of the platform
rec_3pt = Rectangle3Pt(PointA="1092.20,299.50,-7.50", PointB="596.10,299.50,-6.50", PointC="598.40,-301.45,-6.25")  # -> Rectangle, Length

# ---- group: Robot Data
pt_3 = ConstructPoint(XCoordinate=0, YCoordinate=0, ZCoordinate=0)
list = RobotsLibrary(
    {"CITA-IRB1600-145 + Turntable", "CITA-IRB1600-145 + IRB140", "CITA-IRB1600-145", "CITA-IRB140", "CITA-UR5e", "ETH-Gantry", "iaac-KR150-2_110", "iaac-IRB140", "iaac-IRB120", "iaac-IRB6640-130-320"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}, selected="UR10e",
    Type=0)
xy = XYPlane(Origin=pt_3)
load_robot = LoadRobotSystem(Name=list, Base=xy)

# ----
xy_2 = XYPlane(Origin=rot3d_2.Geometry)

name_of_your_tool = Panel("mechmind")
name_of_your_tool_2 = Panel("sprint")
tool = CreateTool(Name=name_of_your_tool, TCP=xy_2, Weight=0, Centroid=Point(20, 0, 52), Mesh=rot3d.Geometry)  # -> Tool, TCP

# ---- group: Robot Table display
ur_table_iaac = Brep([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])
swatch = ColourSwatch(SwatchColor=RGBA(171, 171, 171, 22))

# ----
original_shapes_after_open_nest = Data(Tree({0;0;0}: [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], {0;1;0}: [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], {0;2;0}: [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], {0;3;0}: [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], {0;4;0}: [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], {1;0;0}: [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]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))
placing_plane = Plane(Tree({0;0;0}: [Plane(origin=(777.9394879, 19.62384358, -6.872682449), x=(0.9963657119, -0.08517844874, 0), y=(0.08517844874, 0.9963657119, 0))], {0;1;0}: [Plane(origin=(897.3313625, 46.66484704, -6.872682449), x=(0.09888550402, -0.9950988178, 0), y=(0.9950988178, 0.09888550402, 0))], {0;2;0}: [Plane(origin=(939.2213723, -65.49675217, -6.872682449), x=(-0.9945770469, 0.1040023936, 0), y=(-0.1040023936, -0.9945770469, 0))], {0;3;0}: [Plane(origin=(855.1046311, -70.8515145, -6.872682449), x=(-0.3592326889, 0.9332480245, 0), y=(-0.9332480245, -0.3592326889, 0))], {0;4;0}: [Plane(origin=(819.9109618, 106.4236226, -6.872682449), x=(0.9490485358, -0.3151299361, 0), y=(0.3151299361, 0.9490485358, 0))], {1;0;0}: [Plane(origin=(641.4212317, 90.41476989, -6.872682449), x=(0.6185157993, -0.7857723627, 0), y=(0.7857723627, 0.6185157993, 0))]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))
unused_tiles = Curve([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])
# Robotic Fabrication
pick_plane = Plane(Tree({0;0;0}: [Plane(origin=(-25.67206772, -818.8717474, -176.2081778), x=(0.9973954945, -0.07212646973, 0), y=(0.07212646973, 0.9973954945, 0))], {0;1;0}: [Plane(origin=(178.4517639, -843.3320367, -178.0746086), x=(-0.08797961136, -0.9961222756, 0), y=(0.9961222756, -0.08797961136, 0))], {0;2;0}: [Plane(origin=(648.8077402, -727.7636143, -176.4264844), x=(0.5748791899, -0.8182383009, 0), y=(0.8182383009, 0.5748791899, 0))], {0;3;0}: [Plane(origin=(-128.6781329, -802.6291815, -180.149371), x=(0.2695327283, -0.9629912296, 0), y=(0.9629912296, 0.2695327283, 0))], {0;4;0}: [Plane(origin=(226.5363153, -706.8863559, -178.4913376), x=(0.3758927098, -0.9266631916, 0), y=(0.9266631916, 0.3758927098, 0))], {1;0;0}: [Plane(origin=(-276.9662354, -1022.641488, -177.6296302), x=(-0.2918292275, 0.9564704397, 0), y=(-0.9564704397, -0.2918292275, 0))]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))
dash = DashPattern(Curve=unused_tiles, Pattern=Slider(7, range=0..10))  # -> Dashes, Gaps
xy_3 = XYPlane(Origin=pick_plane)
pflip = FlipPlane(Plane=xy_3, ReverseX=False, ReverseY=False, SwapAxes=True)

# ---- group: Align to the robot
deplane = DeconstructPlane(Plane=pflip)  # -> Origin, XAxis, YAxis, ZAxis
xy_4 = XYPlane(Origin=Point(0, 0, 0))
project = Project(Geometry=xy_4, Plane=deplane.Origin)  # -> Geometry, Transform
ln = Line(StartPoint=deplane.Origin, EndPoint=project.Geometry)
align = AlignPlane(Plane=pflip, Direction=ln)  # -> Plane, Angle

# ----
rotate = Rotate(Geometry=align.Plane, Angle=degrees(1.570796327), Plane=xy_3)  # -> Geometry, Transform
pl_origin = PlaneOrigin(Base=rotate.Geometry, Origin=placing_plane)
pln = Plane(rotate.Geometry)
picking_planes = Plane(simplify(pln))
u_text = UserText(Content=original_shapes_after_open_nest, UserTextMode=0)  # -> simplify(Content), Keys, Values

picking_planes_2 = Plane(simplify(picking_planes))
Z = UnitZ(Factor=Slider(-5, range=-100..100))
move = Move(Geometry=picking_planes_2, Motion=Z)  # -> Geometry, Transform

item = ListItem(List=u_text.Values, Index=0, Wrap=True)  # -> Item, Item1, Item2, Item3

list_2 = FlagFields({"Shoulder": 1, "Elbow": 2, "Wrist": 4}, selected="Shoulder")
speed_fast = Panel("100")
wait_time = Panel("2")
safe_intermediate_point = Point(Point(394.9339287, -761.6812967, 236.5973737))
clearence_plane = Panel("-60")
speed_slow = Panel("50")
end_effector_digital_output = Panel("0")

wait = Wait(Time=wait_time)

# ---- group: Safe middle position
xy_5 = XYPlane(Origin=safe_intermediate_point)
pflip_2 = FlipPlane(Plane=xy_5, ReverseX=False, ReverseY=False, SwapAxes=True)
lng = ListLength(List=move.Geometry)
repeat = RepeatData(Data=pflip_2, Length=lng)  # -> simplify(Data)

# ----
wait_2 = Wait(Time=wait_time)

# ---- group: Extrusion On
setdo = SetDO(DO=end_effector_digital_output, Value="TRUE")
merge = Merge(Data1=wait_2, Data2=setdo, Data3=wait_2)
groupcmd = GroupCommand(Commands=merge)
list_3 = ValueList({"Joint", "Linear"}, selected="Linear")
target = CreateTarget(
    Plane=move.Geometry,
    RobConf=list_2,
    Motion=list_3,
    Tool=tool.Tool,
    Speed=speed_slow,
    Zone="5",
    Command=groupcmd,
    IsCartesian=True)

# ----
capture_pose01 = Panel("""90.00
-80.00
65.00
-75.00
-90.00
0.00""")

# ---- group: 00-Start End position
degtorad = DegreesToRadians(Degrees=capture_pose01, RobotSystem=load_robot, MechanicalGroup=0)
target_2 = CreateTarget(Joints=degtorad, Tool=tool.Tool, Speed=speed_fast, Zone="10", IsCartesian=False)

# ---- group: Main Code
list_4 = ValueList({"Joint", "Linear"}, selected="Joint")
target_3 = CreateTarget(Plane=repeat, RobConf=list_2, Motion=list_4, Tool=tool.Tool, Speed=speed_fast, Zone="5", IsCartesian=True)

# ---- group: Starting Offset
pl_offset = PlaneOffset(BasePlane=move.Geometry, Offset=clearence_plane)
list_5 = ValueList({"Joint", "Linear"}, selected="Joint")
target_4 = CreateTarget(Plane=pl_offset, RobConf=list_2, Motion=list_5, Tool=tool.Tool, Speed=speed_fast, Zone="5", IsCartesian=True)

# ---- group: simulation
number_slider_2 = Slider(0.322, range=0..1)

# ---- group: IP Adrress
panel = Panel("192.168.56.101")

# ---- group: Upload
button = Button()

# ---- group: Play
button_2 = Button()

# ---- group: Pause
button_3 = Button()

# ----
picking_planes_3 = Plane(simplify(picking_planes))

# ---- group: Preview table and robot
preview = CustomPreview(Geometry=ur_table_iaac, Shader=swatch)
toggle = GroupToggle(ToggleActive=False, ToggleVisible=True)  # disabled

# ---- group: Show all tiles
preview_2 = CustomPreview(
    Geometry=dash.Dashes,
    Material={diffuse=RGB(191, 191, 191), emission=RGB(57, 57, 57), shine=0.5, specular=RGB(255, 255, 255), transparency=0})
toggle_2 = GroupToggle(ToggleActive=False, ToggleVisible=True)  # disabled

# ---- group: flip if more than 180
number_slider_3 = Slider(180, range=0..1000)  # disabled

# ---- group: plane deviation in degrees
pl_origin_2 = PlaneOrigin(Base=placing_plane, Origin=pick_plane)
deplane_2 = DeconstructPlane(Plane=pl_origin_2)  # -> Origin, XAxis, YAxis, ZAxis
deplane_3 = DeconstructPlane(Plane=pick_plane)  # -> Origin, XAxis, YAxis, ZAxis

# ----
xy_6 = XYPlane(Origin=pl_origin_2)

# ---- group: plane deviation in degrees (continued)
angle = Angle(VectorA=deplane_2.XAxis, VectorB=deplane_3.XAxis, Plane=xy_6)  # -> Angle, Reflex
deg = Degrees(Radians=angle.Angle)

# ---- group: flip if more than 180 (continued)
neg_2 = Negative(Value=angle.Reflex)  # disabled
larger = LargerThan(FirstNumber=deg, SecondNumber=number_slider_3)  # -> LargerThan, OrEqualTo; disabled
deg_2 = Degrees(Radians=neg_2)  # disabled
p_n_c = PickNChoose(Pattern=larger.LargerThan, Stream0=deg, Stream1=deg_2)  # disabled

# ----
rotate_2 = Rotate(Geometry=pl_origin, Angle=degrees(deg), Plane=pl_origin)  # -> Geometry, Transform
pln_2 = Plane(rotate_2.Geometry)
placing_plane_2 = Plane(simplify(pln_2))

# ---- group: test
orient = Orient(Geometry=original_shapes_after_open_nest, Source=picking_planes, Target=placing_plane_2)  # -> Geometry, Transform

# ----
placing_plane_3 = Plane(simplify(placing_plane_2))

# ---- group: Show all tiles (continued)
preview_3 = CustomPreview(Geometry=[orient.Geometry, u_text.Content], Material=item.Item2)

# ---- group: Extrusion Off
setdo_2 = SetDO(DO=end_effector_digital_output, Value="False")
merge_2 = Merge(Data1=wait, Data2=setdo_2, Data3=wait)
groupcmd_2 = GroupCommand(Commands=merge_2)
list_6 = ValueList({"Joint", "Linear"}, selected="Linear")
target_5 = CreateTarget(
    Plane=placing_plane_3,
    RobConf=list_2,
    Motion=list_6,
    Tool=tool.Tool,
    Speed=speed_slow,
    Zone="5",
    Command=groupcmd_2,
    IsCartesian=True)

# ---- group: Ending Offset
pl_offset_2 = PlaneOffset(BasePlane=placing_plane_3, Offset=clearence_plane)
list_7 = ValueList({"Joint", "Linear"}, selected="Joint")
target_6 = CreateTarget(Plane=pl_offset_2, RobConf=list_2, Motion=list_7, Tool=tool.Tool, Speed=speed_fast, Zone="5", IsCartesian=True)

# ----
pl_offset_3 = PlaneOffset(BasePlane=placing_plane_3, Offset=clearence_plane)
list_8 = ValueList({"Joint", "Linear"}, selected="Linear")
target_7 = CreateTarget(Plane=pl_offset_3, RobConf=list_2, Motion=list_8, Tool=tool.Tool, Speed=speed_slow, Zone="5", IsCartesian=True)

merge_3 = Merge(
    Data1=simplify(target_4),
    Data2=simplify(target),
    Data3=simplify(target_3),
    Data4=simplify(target_6),
    Data5=simplify(target_5),
    Data6=simplify(target_7),
    Data7=simplify(target_3))
panel_2 = Panel(merge_3)
entwine = Entwine(Branch00=target_2, Branch01=merge_3, Branch02=target_2, FlattenInputs=True)

name_of_the_program = Panel("printing")
program = CreateProgram(Name=name_of_the_program, RobotSystem=load_robot, Targets1=flatten(entwine), StepSize=1)  # -> Program, Code, Duration, Warnings, Errors
check_errors = Panel(program.Errors)
sim = ProgramSimulation(Program=program.Program, Time=number_slider_2, Normalized=True)  # -> SystemMeshes, JointRotations, Plane, Index, Time, Program, Errors

# ---- group: exporting the file
cluster = Cluster(data=program.Code)
path = FilePath("D:\\")
file_name = Panel("test01")
txt = Text(flatten(cluster))
python = GhPythonScript(program=txt, path=path, name=file_name, write=Button())  # -> out, a; inputs program: list
# ---------- python: Python ----------
__author__ = "Ric M"
__version__ = "2023.03.16"

import rhinoscriptsyntax as rs

if write:
    with open(path + name + '.script', 'w') as file:
        for line in program:
            file.write(line)
            file.write('\n')
# ---------- end python ----------

# ---- group: Display Data
trail = SimpleTrail(Program=sim.Program, Length="20000", MechanicalGroup=0)
split = SplitList(List=sim.SystemMeshes, Index="7")  # -> ListA, ListB
swatch_2 = ColourSwatch(SwatchColor=RGB(219, 219, 219))
swatch_3 = ColourSwatch(SwatchColor=RGB(212, 212, 212))
preview_4 = CustomPreview(Geometry=trail, Material=ColourSwatch(SwatchColor=RGB(255, 0, 195)))

# ---- group: printing time
division = Division(A=program.Duration, B=60)
round = Round(Number=division)  # -> Nearest, Floor, Ceiling
time_in_minutes = Panel(round.Nearest)

# ----
remote = RemoteConnection(Program=sim.Program, IP=panel, Upload=button, Play=button_2, Pause=button_3)

# ---- group: Preview table and robot (continued)
preview_5 = CustomPreview(Geometry=split.ListA, Shader=swatch_2)
preview_6 = CustomPreview(Geometry=split.ListB, Shader=swatch_3)

# ----
to_export_code_to_prg_file = Panel(txt)

# ---- group: Preview tiles in simulation / find if the tile taken or not and which tile index
number_of_target_per_move = Slider(7, range=0..10)
subtraction = Subtraction(A=sim.Index, B=1)
division_2 = Division(A=subtraction, B=number_of_target_per_move)
round_2 = Round(Number=division_2)  # -> Nearest, Floor, Ceiling

subtraction_2 = Subtraction(A=division_2, B=round_2.Floor)
panel_3 = Panel(subtraction_2)
inc = Includes(Value=panel_3, Domain=" 0.15 To 0.58")  # -> Includes, Deviation

# ---- group: Preview tiles in simulation
original_shapes_after_open_nest_2 = Data(flatten(original_shapes_after_open_nest))
item_2 = ListItem(List=flatten(original_shapes_after_open_nest_2), Index=round_2.Floor, Wrap=True)
item_3 = ListItem(List=flatten(item_2), Index=round_2.Floor, Wrap=True)
cull = CullPattern(List=item_3, CullPattern=inc.Includes)

u_text_2 = UserText(Content=cull, UserTextMode=0)  # -> simplify(Content), Keys, Values
item_4 = ListItem(List=u_text_2.Values, Index=0, Wrap=True)  # -> Item, Item1, Item2, Item3
panel_4 = Panel(item_4.Item)
panel_5 = Panel(item_4.Item1)
panel_6 = Panel(item_4.Item2)

toggle_3 = GroupToggle(ToggleActive=True, ToggleVisible=False)  # disabled

item_5 = ListItem(List=flatten(picking_planes_3), Index=round_2.Floor, Wrap=True)
item_6 = ListItem(List=sim.Plane, Index=7, Wrap=True)
swatch_4 = ColourSwatch(SwatchColor=RGB(0, 0, 0))

# ---- group: Preview tiles in simulation / correct tcp
Z_2 = UnitZ(Factor=Slider(-7, range=-10..0))
move_2 = Move(Geometry=item_6, Motion=Z_2)  # -> Geometry, Transform

# ---- group: Preview tiles in simulation (continued)
orient_2 = Orient(Geometry=u_text_2.Content, Source=item_5, Target=move_2.Geometry)  # -> Geometry, Transform
srf = Surface(orient_2.Geometry)
area = Area(Geometry=srf)  # -> Area, Centroid

preview_7 = CustomPreview(Geometry=srf, Material=item_4.Item2)
tag = TextTag(Location=area.Centroid, Text=item_4.Item, Colour=swatch_4)

# ==== cluster Cluster
data = ClusterInput()

# ---- group: Code to Export
data_2 = Data(data)
trim = TrimTree(Tree=data_2, Depth=expr("2", 1))
graft = GraftTree(Tree=trim, IncludeEmptyLists=True, IncludeNullItems=True)  # -> simplify(Tree)
panel = Panel("""-1
0""")
cull_i = CullIndex(List=flatten(graft), Indices=panel, Wrap=True)

# ----
L = ClusterOutput(cull_i)
